# Grasshopper definition PATREON_MEMBERSHIP_ONLY_Rhino7_GHPYTHON_WickersonStudios_BACK_TO_THE_BASICS_(2D Array of Points)_004.gh (Grasshopper 1.0.7)
# Copyright: bernhard muller bijoutiers
# plug-ins: Workshop, Bifocals

# https://github.com/mwickerson/PATREON_MEMBERS_ONLY_ghpythonNodeBasics
# gitHub: Mwickerson
wickerson_s_first_grasshopper_component = WickersonsFirstGrasshopperComponent()  # disabled

number_slider = Slider(10, range=0..10)
number_slider_2 = Slider(5, range=0..10)
# 2D ARRAY OF POINTS
number_slider_3 = Slider(2, range=0..10)
ghpython_script = GhPythonScript(n=number_slider_3, m=number_slider_2, step=Slider(8.98, range=0..10))  # -> out, pointB_out; inputs n: Int32, m: Int32
# ---------- ghpython_script: Python ----------
import rhinoscriptsyntax as rs
import Rhino.Geometry as rg

pointsB = []

for i in range(n):
    for j in range(m):
        if j > n:
            ptB = rg.Point3d(step+j,(n+m)*j,n*j*j)
            pointsB.append(ptB)
        else:
            ptB = rg.Point3d(step+j*j, (n+m)*j, n*j)
            pointsB.append(ptB)

pointB_out = pointsB
# ---------- end ghpython_script ----------
point = Point(ghpython_script.pointB_out)
interpolate = Interpolate(Vertices=point, Degree=3, Periodic=False, KnotStyle=1)  # -> Curve, Length, Domain
construct_point = ConstructPoint(XCoordinate=0, YCoordinate=0, ZCoordinate=0)
unit_z = UnitZ(Factor=1)
line_sdl = LineSDL(Start=construct_point, Direction=unit_z, Length=1)
revolution = Revolution(Curve=interpolate.Curve, Axis=line_sdl, Domain=Domain(0, 6.283185307))
cap_holes = CapHoles(Brep=revolution)
deconstruct_brep = DeconstructBrep(Brep=cap_holes)  # -> Faces, Edges, Vertices
cull_index = CullIndex(List=deconstruct_brep.Faces, Indices="1", Wrap=True)
dispatch = Dispatch(List=cull_index, DispatchPattern=[True, False])  # -> ListA, ListB
unit_z_2 = UnitZ(Factor=number_slider_2)
geometry = Geometry(dispatch.ListA)
negative = Negative(Value=unit_z_2)
extrude = Extrude(Base=geometry, Direction=negative)
merge = Merge(Data1=cull_index, Data2=extrude)
panel = Panel(merge)
