# Grasshopper definition PATREON_MEMBERSHIP_ONLY_Rhino7_GHPYTHON_WickersonStudios_BACK_TO_THE_BASICS_(2D Array of Points)_004c.gh (Grasshopper 1.0.7)
# Copyright: bernhard muller bijoutiers
# plug-ins: Workshop, Bifocals

# https://github.com/mwickerson/PATREON_MEMBERS_ONLY_ghpythonNodeBasics
# gitHub: Mwickerson
wickerson_s_first_grasshopper_component = WickersonsFirstGrasshopperComponent()  # disabled
# 2D ARRAY OF POINTS
number_slider = Slider(6, range=0..10)
ghpython_script = GhPythonScript(n=number_slider, step=Slider(2, range=0..2))  # -> out, points_out; inputs n: Int32
# ---------- ghpython_script: Python ----------
import Rhino.Geometry as rg

points = []

for i in range(n):
    for j in range(n):
        pt = rg.Point3d(step+i,step+j,i*j/Beth)
        points.append(pt)

points_out = points
# ---------- end ghpython_script ----------
point = Point(ghpython_script.points_out)
surface_from_points = SurfaceFromPoints(Points=point, UCount=number_slider, Interpolate=False)
sphere = Sphere(Base=point, Radius=Slider(2, range=0..2))

number_slider_2 = Slider(42, range=0..100)
surface = Surface(surface_from_points)
divide_surface = DivideSurface(Surface=surface, UCount=number_slider_2, VCount=number_slider_2)  # -> Points, Normals, Parameters
amplitude = Amplitude(Vector=divide_surface.Normals, Amplitude=Slider(0.981, range=0.001..2))
vector_display = VectorDisplay(Anchor=divide_surface.Points, Vector=divide_surface.Normals)
move = Move(Geometry=divide_surface.Points, Motion=amplitude)  # -> flatten(Geometry), Transform
expression = Expression(x=number_slider_2, Expression="x+1")
surface_from_points_2 = SurfaceFromPoints(Points=move.Geometry, UCount=expression, Interpolate=False)
deconstruct_brep = DeconstructBrep(Brep=surface_from_points_2)  # -> Faces, simplify(graft(Edges)), Vertices
deconstruct_brep_2 = DeconstructBrep(Brep=surface)  # -> Faces, simplify(graft(Edges)), Vertices
loft = Loft(
    Curves=[deconstruct_brep.Edges, deconstruct_brep_2.Edges],
    Options={Adjust=False, Closed=False, LoftEnds=0, LoftSimp=0, LoftType=0, Rebuild=10, Refit=0.01})  # -> flatten(Loft)
merge = Merge(Data1=surface_from_points_2, Data2=loft, Data3=surface)
brep_join = BrepJoin(Breps=merge)  # -> Breps, Closed

dispatch = Dispatch(List=flatten(brep_join.Breps), DispatchPattern=[True, False])  # -> ListA, ListB
solid_difference = SolidDifference(BrepsA=dispatch.ListA, BrepsB=sphere)
polar_array = PolarArray(Geometry=solid_difference, Plane=PlaneXY(0, 0, 0), Count=Slider(7, range=0..10), Angle=6.283185307)  # -> Geometry, Transform
brep_join_2 = BrepJoin(Breps=polar_array.Geometry)  # -> Breps, Closed
