# Grasshopper definition PATREON_MEMBERSHIP_ONLY_Rhino7_GHPYTHON_WickersonStudios_BACK_TO_THE_BASICS_(Array_of_Points)_002.gh (Grasshopper 1.0.7)
# Copyright: bernhard muller bijoutiers
# plug-ins: Workshop, Bifocals

# https://github.com/mwickerson/PATREON_MEMBERS_ONLY_ghpythonNodeBasics
# gitHub: Mwickerson
# ARRAY OF POINT
wickerson_s_first_grasshopper_component = WickersonsFirstGrasshopperComponent()  # disabled
number_slider = Slider(3, range=1..11)
ghpython_script = GhPythonScript(x=number_slider, y=Slider(3, range=0..10))  # -> out, pointA_out, pointB_out; inputs x: Int32, y: Int32
# ---------- ghpython_script: Python ----------
import rhinoscriptsyntax as rs
import Rhino.Geometry as rg

ptsA = []
ptsB = []

for i in range(x):
    ptA = rs.AddPoint(i,0,0)
    ptsA.append(ptA)
    for j in range(y):
        ptB = rg.Point3d(i,i,j*i)
        ptsB.append(ptB)
    

pointA_out = ptsA 
pointB_out = ptsB
# ---------- end ghpython_script ----------
distance = Distance(PointA=ghpython_script.pointA_out, PointB=ghpython_script.pointB_out)
panel = Panel(distance)
unit_z = UnitZ(Factor=distance)
point = Point(ghpython_script.pointB_out)
point_2 = Point(ghpython_script.pointA_out)
move = Move(Geometry=point_2, Motion=unit_z)  # -> Geometry, Transform
number_slider_2 = Slider(0.11, range=0..1)
number_slider_3 = Slider(1, range=0..1)
line = Line(StartPoint=move.Geometry, EndPoint=point)  # -> graft(Line)
multiplication = Multiplication(A=number_slider_2, B=Slider(10, range=0..10))
unit_x = UnitX(Factor=multiplication)
surface_from_points = SurfaceFromPoints(Points=point, UCount=number_slider, Interpolate=False)
clean_tree = CleanTree(RemoveNulls=number_slider_3, RemoveInvalid=number_slider_3, RemoveEmpty=number_slider_3, Tree=line)  # -> simplify(Tree)
interpolate = Interpolate(Vertices=move.Geometry, Degree=3, Periodic=False, KnotStyle=1)  # -> Curve, Length, Domain
negative = Negative(Value=unit_x)
extrude = Extrude(Base=surface_from_points, Direction=negative)
pipe = Pipe(Curve=[clean_tree, interpolate.Curve], Radius=number_slider_2, Caps="2")
merge = Merge(Data1=pipe, Data2=extrude)
