# Grasshopper definition PATREON_MEMBERSHIP_ONLY_Rhino7_GHPYTHON_WickersonStudios_BACK_TO_THE_BASICS_(Conditional_2)_005.gh (Grasshopper 1.0.7)
# Copyright: bernhard muller bijoutiers
# plug-ins: Workshop, Bifocals

# https://github.com/mwickerson/PATREON_MEMBERS_ONLY_ghpythonNodeBasics
# gitHub: Mwickerson
# 2D ARRAY OF POINTS (CONDITIONALS 2)
wickerson_s_first_grasshopper_component = WickersonsFirstGrasshopperComponent()  # disabled
ghpython_script = GhPythonScript(
    number1=Slider(6, range=0..10),
    number2=Slider(3, range=0..10),
    start=Slider(1, range=0..10),
    stop=Slider(30, range=0..30),
    step=Slider(5, range=0..10))  # -> out, points1_out, points2_out, points3_out; inputs number1: Int32, number2: Int32, start: Int32, stop: Int32, step: Int32
# ---------- ghpython_script: Python ----------
import Rhino.Geometry as rg

points1 = []
points2 = []
points3 = []

for x in range(start, stop,step):
    for y in range(start, stop,step):
        pt = rg.Point3d(x,y,x*y)
        if x % number1 == 0 and y % number2 == 0:
            points1.append(pt)
        elif x % number1 == 0 or y % number2 == 0:
            points2.append(pt)
        else:
            points3.append(pt)

points1_out = points1
points2_out = points2
points3_out = points3
# ---------- end ghpython_script ----------
point = Point(ghpython_script.points1_out)
point_2 = Point(ghpython_script.points2_out)
point_3 = Point(ghpython_script.points3_out)
line = Line(StartPoint=point_2, EndPoint=point_3)
line_2 = Line(StartPoint=point, EndPoint=point_3)
line_3 = Line(StartPoint=point, EndPoint=point_2)
merge = Merge(Data1=line_3, Data2=line_2, Data3=line)
polar_array = PolarArray(Geometry=merge, Plane=PlaneXY(0, 0, 0), Count=Slider(10, range=2..10), Angle=6.283185307)  # -> Geometry, Transform
range = Range(Domain=Domain(0, 1), Steps=10)
graph_mapper = GraphMapper(
    range,
    x0=0,
    x1=1,
    y0=0,
    y1=1,
    Ox=0.495811522,
    Oy=0.1322410703,
    Px=0.8413414955,
    Py=0.6618031263,
    container_name="Parabola")
pipe_variable = PipeVariable(Curve=reparameterize(polar_array.Geometry), Parameters=range, Radii=graph_mapper, Caps="2")
panel = Panel(pipe_variable)
