# Grasshopper definition PATREON_MEMBERSHIP_ONLY_Rhino7_GHPYTHON_WickersonStudios_BACK_TO_THE_BASICS_(Conditionals)_003.gh (Grasshopper 1.0.7)
# Copyright: bernhard muller bijoutiers
# plug-ins: Workshop, Bifocals

# https://github.com/mwickerson/PATREON_MEMBERS_ONLY_ghpythonNodeBasics
# gitHub: Mwickerson
# CONDITIONALS
wickerson_s_first_grasshopper_component = WickersonsFirstGrasshopperComponent()  # disabled
ghpython_script = GhPythonScript(x=Slider(3, range=1..10), y=Slider(5, range=0..5), step=Slider(30, range=0..30), z=Slider(6, range=0..10))  # -> out, pointA_out, pointB_out; inputs x: Int32, y: Int32, z: Int32
# ---------- ghpython_script: Python ----------
import rhinoscriptsyntax as rs
import Rhino.Geometry as rg

pointsA = []
pointsB = []

for i in range(x):
    if i > y:
        ptA = rs.AddPoint(step+i,z*i,i*i)
        pointsA.append(ptA)
    else:
        ptA = rs.AddPoint(step+i*i, z*i, i)
        pointsA.append(ptA)
        
for j in range(y):
    if j > x:
        ptB = rg.Point3d(step+j,(x+y)*j,x*j*j)
        pointsB.append(ptB)
    else:
        ptB = rg.Point3d(step+j*j, (x+y)*j, x*j)
        pointsB.append(ptB)

pointA_out = pointsA
pointB_out = pointsB
# ---------- end ghpython_script ----------
construct_point = ConstructPoint(XCoordinate=0, YCoordinate=0, ZCoordinate=0)
unit_z = UnitZ(Factor=1)
point = Point(ghpython_script.pointA_out)
point_2 = Point(ghpython_script.pointB_out)
line_sdl = LineSDL(Start=construct_point, Direction=unit_z, Length=Slider(100, range=0..100))
interpolate = Interpolate(Vertices=point_2, Degree=3, Periodic=False, KnotStyle=1)  # -> Curve, Length, Domain
interpolate_2 = Interpolate(Vertices=point, Degree=3, Periodic=False, KnotStyle=1)  # -> Curve, Length, Domain
revolution = Revolution(Curve=interpolate.Curve, Axis=line_sdl, Domain=Domain(0, 6.283185307))
revolution_2 = Revolution(Curve=interpolate_2.Curve, Axis=line_sdl, Domain=Domain(0, 6.283185307))
deconstruct_brep = DeconstructBrep(Brep=revolution)  # -> Faces, Edges, Vertices
deconstruct_brep_2 = DeconstructBrep(Brep=revolution_2)  # -> Faces, Edges, Vertices
list_item = ListItem(List=deconstruct_brep.Edges, Index=0, Wrap=True)
list_item_2 = ListItem(List=deconstruct_brep_2.Edges, Index=0, Wrap=True)
boundary_surfaces = BoundarySurfaces(Edges=list_item)
boundary_surfaces_2 = BoundarySurfaces(Edges=list_item_2)
unit_x = UnitX(Factor=Slider(100, range=0..100))
merge = Merge(Data1=revolution, Data2=boundary_surfaces)
merge_2 = Merge(Data1=revolution_2, Data2=boundary_surfaces_2)
move = Move(Geometry=merge, Motion=unit_x)  # -> Geometry, Transform
geometry = Geometry(merge_2)
panel = Panel(geometry)
param_viewer = ParamViewer(merge_2)
