# Grasshopper definition PATREON_MEMBERSHIP_ONLY_Rhino7_GHPYTHON_WickersonStudios_BACK_TO_THE_BASICS_(GhPython_Component)_001.gh (Grasshopper 1.0.7)
# Copyright: bernhard muller bijoutiers
# plug-ins: Workshop, Bifocals

# www.wickersonstudios.com
# gitHub: Mwickerson
# ALGORITHMS RECURSION 001
wickerson_s_first_grasshopper_component = WickersonsFirstGrasshopperComponent()  # disabled
number_slider = Slider(5, range=0..10)  # disabled
number_slider_2 = Slider(0, range=0..10)  # disabled
number_slider_3 = Slider(4, range=0..10)  # disabled
# ALGORITHMS RECURSION 002
number_slider_4 = Slider(4, range=0..10)  # disabled
number_slider_5 = Slider(6, range=0..10)
# ALGORITHMS FRACTAL 003
number_slider_6 = Slider(23, range=0..40)
ghpython_script = GhPythonScript(startNumber=number_slider_2, degree=number_slider_3, step=number_slider)  # -> out, numberList_out; inputs startNumber: Int32, degree: Int32, step: Int32; disabled
# ---------- ghpython_script: Python ----------
import rhinoscriptsyntax as rs

def Iteration(number,degree):
    newNumber = number + step
    numberList.append(newNumber)
    
    if(degree>0):
        Iteration(newNumber,degree-1)
        
    return numberList
    
    
numberList = []
numberList.append(startNumber)
numberList_out = Iteration(startNumber,degree)
# ---------- end ghpython_script ----------
polygon = Polygon(Plane=PlaneXY(0, 0, 0), Radius=3, Segments=Slider(5, range=3..10), FilletRadius=0)  # -> Polygon, Length
polygon_2 = Polygon(Plane=PlaneXY(0, 0, 0), Radius=3, Segments=number_slider_4, FilletRadius=0)  # -> Polygon, Length; disabled
addition = Addition(A=number_slider_5, B=number_slider_6)
ghpython_script_2 = GhPythonScript()  # -> Out, A
ghpython_script_3 = GhPythonScript(startPolyline=polygon.Polygon, degree=number_slider_5, divide=addition)  # -> out, polylineList_out; inputs degree: Int32, divide: Int32
# ---------- ghpython_script_3: Python ----------
import rhinoscriptsyntax as rs

def DrawPoly(polyLine,degree):
    pts = []
    segment = rs.ExplodeCurves(polyLine)
    for i in range(len(segment)):
        pt = rs.DivideCurve(segment[i],divide)
        pts.append(pt[4])
        
    pts.append(pts[0])
    newPolyline = rs.AddPolyline(pts)
    polylineList.append(newPolyline)
    
    if(degree>0):
        DrawPoly(newPolyline,degree-1)
        
    return polylineList

polylineList = []
polylineList.append(startPolyline)
polylineList_out = DrawPoly(startPolyline,degree)
# ---------- end ghpython_script_3 ----------
ghpython_script_4 = GhPythonScript(startPolyline=polygon_2.Polygon)  # -> out, a; disabled
# ---------- ghpython_script_4: Python ----------
import rhinoscriptsyntax as rs

polylineList = []
polylineList.append(startPolyline)
# ---------- end ghpython_script_4 ----------
panel = Panel(ghpython_script.numberList_out)  # disabled
construct_domain = ConstructDomain(DomainStart=Slider(5, range=0..10), DomainEnd=Slider(10, range=0..10))
panel_2 = Panel(ghpython_script_4.out)  # disabled
panel_3 = Panel(ghpython_script_4.a)  # disabled
curve = Curve(ghpython_script_3.polylineList_out)
list_length = ListLength(List=curve)
range = Range(Domain=construct_domain, Steps=expr("x-1", list_length))
unit_z = UnitZ(Factor=range)
extrude = Extrude(Base=curve, Direction=unit_z)
