# Grasshopper definition PATREON_MEMBERSHIP_ONLY_Rhino7_GHPYTHON_WickersonStudios_BACK_TO_THE_BASICS_(NEW_001)_008.gh (Grasshopper 1.0.7)
# Copyright: bernhard muller bijoutiers
# plug-ins: Workshop, Bifocals

# https://github.com/mwickerson/PATREON_MEMBERS_ONLY_ghpythonNodeBasics
# gitHub: Mwickerson
# NEW_001
wickerson_s_first_grasshopper_component = WickersonsFirstGrasshopperComponent()  # disabled
number_slider = Slider(7, range=0..10)  # disabled
number_slider_2 = Slider(8, range=0..10)  # disabled
number_slider_3 = Slider(3, range=0..10)
ghpython_script = GhPythonScript(x=number_slider, y=number_slider_2)  # -> out, pointA_out; inputs x: Int32, y: Int32; disabled
# ---------- ghpython_script: Python ----------
import rhinoscriptsyntax as rs
import math

ptsA = []

for i in range(x):
    for j in range(y):
        ptA = rs.AddPoint((i,j,math.sqrt(3*i*j)))
        ptsA.append(ptA)

pointA_out = ptsA
# ---------- end ghpython_script ----------
ghpython_script_2 = GhPythonScript(x=number_slider_3, y=Slider(5, range=0..10), z=Slider(3, range=0..10), amp=Slider(1.25, range=0..10))  # -> out, pointA_out; inputs x: Int32, y: Int32, z: Int32
# ---------- ghpython_script_2: Python ----------
import rhinoscriptsyntax as rs
import math

ptsA = []

for i in range(x):
    for j in range(y):
        for k in range(z):
            ptA = rs.AddPoint((i,j,math.sqrt(amp*i*j*k)))
            ptsA.append(ptA)

pointA_out = ptsA
# ---------- end ghpython_script_2 ----------
number_slider_4 = Slider(4, range=0..10)  # disabled
surface_from_points = SurfaceFromPoints(Points=flatten(ghpython_script.pointA_out), UCount=number_slider, Interpolate=False)  # disabled
surface_from_points_2 = SurfaceFromPoints(Points=flatten(ghpython_script_2.pointA_out), UCount=number_slider_3, Interpolate=False)
polar_array = PolarArray(Geometry=surface_from_points, Plane=PlaneXY(0, 0, 0), Count=number_slider_4, Angle=6.283185307)  # -> Geometry, Transform; disabled
polar_array_2 = PolarArray(Geometry=surface_from_points_2, Plane=PlaneXY(0, 0, 0), Count=Slider(4, range=0..10), Angle=6.283185307)  # -> Geometry, Transform
project = Project(Geometry=polar_array.Geometry, Plane=PlaneXY(0, 0, 0))  # -> Geometry, Transform; disabled
project_2 = Project(Geometry=polar_array_2.Geometry, Plane=PlaneXY(0, 0, 0))  # -> Geometry, Transform
number_slider_5 = Slider(13, range=0..15)  # disabled
deconstruct_brep = DeconstructBrep(Brep=project.Geometry)  # -> Faces, simplify(graft(Edges)), Vertices; disabled
deconstruct_brep_2 = DeconstructBrep(Brep=polar_array.Geometry)  # -> Faces, simplify(graft(Edges)), Vertices; disabled
deconstruct_brep_3 = DeconstructBrep(Brep=project_2.Geometry)  # -> Faces, simplify(graft(Edges)), Vertices
deconstruct_brep_4 = DeconstructBrep(Brep=polar_array_2.Geometry)  # -> Faces, simplify(graft(Edges)), Vertices
number_slider_6 = Slider(0.32, range=0..10)  # disabled
loft = Loft(
    Curves=[deconstruct_brep.Edges, deconstruct_brep_2.Edges],
    Options={Adjust=False, Closed=False, LoftEnds=0, LoftSimp=0, LoftType=0, Rebuild=10, Refit=0.01})  # disabled
list_item = ListItem(List=flatten(deconstruct_brep_2.Edges), Index=number_slider_5, Wrap=True)  # disabled
loft_2 = Loft(
    Curves=[deconstruct_brep_3.Edges, deconstruct_brep_4.Edges],
    Options={Adjust=False, Closed=False, LoftEnds=0, LoftSimp=0, LoftType=0, Rebuild=10, Refit=0.01})
panel = Panel("2")  # disabled
pipe = Pipe(Curve=deconstruct_brep_2.Edges, Radius=number_slider_6, Caps=panel)  # disabled
xy_plane = XYPlane(Origin=Point(0, 0, 0))
merge = Merge(Data1=loft_2, Data2=deconstruct_brep_3.Edges, Data3=polar_array_2.Geometry)
mirror = Mirror(Geometry=merge, Plane=xy_plane)  # -> Geometry, Transform
