# Grasshopper definition PATREON_MEMBERSHIP_ONLY_Rhino7_GHPYTHON_WickersonStudios_BACK_TO_THE_BASICS_(NEW_002)_009.gh (Grasshopper 1.0.7)
# Copyright: bernhard muller bijoutiers
# plug-ins: Workshop, Bifocals

# https://github.com/mwickerson/PATREON_MEMBERS_ONLY_ghpythonNodeBasics
# gitHub: Mwickerson
# NEW_002
wickerson_s_first_grasshopper_component = WickersonsFirstGrasshopperComponent()  # disabled
number_slider = Slider(34, range=0..100)
number_slider_2 = Slider(4, range=0..10)
number_slider_3 = Slider(7, range=0..10)
construct_point = ConstructPoint(XCoordinate=Slider(1, range=0..10), YCoordinate=Slider(5, range=0..10), ZCoordinate=Slider(3, range=0..10))
ghpython_script = GhPythonScript(
    x=number_slider_3,
    y=number_slider_2,
    z=Slider(4, range=0..10),
    amp=Slider(0.62, range=0..1),
    listItem=number_slider,
    insertPoint=construct_point,
    insertLocation=Slider(28, range=0..100))  # -> out, pointA_out, a, d, e, f; inputs x: Int32, y: Int32, z: Int32, listItem: Int32, insertPoint: Point3d, insertLocation: Int32
# ---------- ghpython_script: Python ----------
import rhinoscriptsyntax as rs
import math

ptsA = []

for i in range(x):
    for j in range(y):
        for k in range(z):
            ptA = rs.AddPoint((i,math.sqrt(amp*i*j*k),j))
            ptsA.append(ptA)

pointA_out = ptsA

a = pointA_out[listItem]
b = pointA_out.remove(a)
c = pointA_out.insert(insertLocation,insertPoint)
d = pointA_out.count(insertPoint)
#e = pointA_out.sort()
# ---------- end ghpython_script ----------
panel = Panel(ghpython_script.a)
panel_2 = Panel(ghpython_script.d)
point = Point(ghpython_script.a)
list_item = ListItem(List=ghpython_script.pointA_out, Index=number_slider, Wrap=True)  # disabled
surface_from_points = SurfaceFromPoints(Points=ghpython_script.pointA_out, UCount=number_slider_3, Interpolate=False)
sphere = Sphere(Base=point, Radius=Slider(1.06, range=0..3))
split_brep = SplitBrep(Brep=surface_from_points, Cutter=sphere)
dispatch = Dispatch(List=flatten(split_brep), DispatchPattern=[True, False])  # -> ListA, ListB
unit_y = UnitY(Factor=number_slider_2)
geometry = Geometry(dispatch.ListA)
extrude = Extrude(Base=geometry, Direction=unit_y)
