# Grasshopper definition PATREON_MEMBERSHIP_ONLY_Rhino7_GHPYTHON_WickersonStudios_BACK_TO_THE_BASICS_(NEW_003)_010.gh (Grasshopper 1.0.7)
# Copyright: bernhard muller bijoutiers
# plug-ins: Workshop, Bifocals

# https://github.com/mwickerson/PATREON_MEMBERS_ONLY_ghpythonNodeBasics
# gitHub: Mwickerson
# NEW_003
wickerson_s_first_grasshopper_component = WickersonsFirstGrasshopperComponent()  # disabled
number_slider = Slider(5, range=0..10)
number_slider_2 = Slider(5, range=0..10)
number_slider_3 = Slider(45, range=0..99)
number_slider_4 = Slider(10, range=0..10)
construct_point = ConstructPoint(XCoordinate=number_slider, YCoordinate=number_slider_2, ZCoordinate=Slider(4, range=0..10))
construct_point_2 = ConstructPoint(XCoordinate=number_slider, YCoordinate=number_slider_2, ZCoordinate=Slider(2, range=0..10))
ghpython_script = GhPythonScript(
    x=number_slider_4,
    y=Slider(10, range=0..10),
    amp=Slider(0.42, range=0..1),
    listItem=number_slider_3,
    insertPoint=[construct_point, construct_point_2],
    insertLocation=number_slider_3)  # -> out, pointA_out, a, d; inputs x: Int32, y: Int32, listItem: Int32, insertPoint: Point3d, insertLocation: Int32
# ---------- ghpython_script: Python ----------
import rhinoscriptsyntax as rs

ptsA = []

for i in range(x):
    for j in range(y):
        ptA = rs.AddPoint((i,j,0))
        ptsA.append(ptA)

pointA_out = ptsA

a = pointA_out[listItem]
b = pointA_out.remove(a)
c = pointA_out.insert(insertLocation,insertPoint)
d = pointA_out.count(insertPoint)
#e = pointA_out.sort()
# ---------- end ghpython_script ----------
panel = Panel(ghpython_script.d)
panel_2 = Panel(ghpython_script.a)
surface_from_points = SurfaceFromPoints(Points=ghpython_script.pointA_out, UCount=number_slider_4, Interpolate=False)
solid_union = SolidUnion(Breps=surface_from_points)
brep_join = BrepJoin(Breps=flatten(solid_union))  # -> Breps, Closed
