# Grasshopper definition PATREON_MEMBERSHIP_ONLY_Rhino7_GHPYTHON_WickersonStudios_BACK_TO_THE_BASICS_(NEW_004)_011.gh (Grasshopper 1.0.7)
# Copyright: bernhard muller bijoutiers
# plug-ins: Workshop, Bifocals

# https://github.com/mwickerson/PATREON_MEMBERS_ONLY_ghpythonNodeBasics
# gitHub: Mwickerson
# NEW_004
wickerson_s_first_grasshopper_component = WickersonsFirstGrasshopperComponent()  # disabled
number_slider = Slider(72, range=0..99)
number_slider_2 = Slider(10, range=0..10)
construct_point = ConstructPoint(XCoordinate=Slider(5, range=0..10), YCoordinate=Slider(5, range=0..10), ZCoordinate=Slider(4, range=0..10))
construct_point_2 = ConstructPoint(XCoordinate=Slider(0, range=0..10), YCoordinate=Slider(7, range=0..10), ZCoordinate=Slider(0, range=0..10))
ghpython_script = GhPythonScript(
    x=number_slider_2,
    y=Slider(10, range=0..10),
    amp=Slider(0.18, range=0..1),
    listItem=number_slider,
    insertPoint=construct_point,
    insertLocation=number_slider,
    testPoint=construct_point_2)  # -> out, pointA_out, a, b, c, d, e, f, g, h; inputs x: Int32, y: Int32, listItem: Int32, insertPoint: Point3d, insertLocation: Int32, testPoint: Point3d
# ---------- ghpython_script: Python ----------
import rhinoscriptsyntax as rs
import Rhino.Geometry as rg

ptsA = []

for i in range(x):
    for j in range(y):
        vec = rg.Vector3d(i,j,i*j*amp)
        ptA = rg.Point3d(vec)
        #ptA = rs.AddPoint(i,j,i*j*amp)
        ptsA.append(ptA)

pointA_out = ptsA
print pointA_out

a = len(ptsA)
b = max(ptsA)
c = min(ptsA)
d = vec
item = ptsA[3]
e = item in ptsA

print item
print testPoint

f = testPoint in ptsA
g = testPoint not in ptsA

h = b + testPoint
# ---------- end ghpython_script ----------
surface_from_points = SurfaceFromPoints(Points=ghpython_script.pointA_out, UCount=number_slider_2, Interpolate=False)
panel = Panel(ghpython_script.a)
panel_2 = Panel(ghpython_script.d)
panel_3 = Panel(ghpython_script.e)
panel_4 = Panel(ghpython_script.f)
panel_5 = Panel(ghpython_script.g)
panel_6 = Panel(ghpython_script.h)
panel_7 = Panel(ghpython_script.b)
panel_8 = Panel(ghpython_script.c)
panel_9 = Panel(ghpython_script.out)
param_viewer = ParamViewer(ghpython_script.out)
sphere = Sphere(Base=construct_point_2, Radius=1)
sphere_2 = Sphere(Base=ghpython_script.b, Radius=1)
sphere_3 = Sphere(Base=ghpython_script.c, Radius=1)
sphere_4 = Sphere(Base=ghpython_script.h, Radius=1)
