# Grasshopper definition PATREON_MEMBERSHIP_ONLY_Rhino7_GHPYTHON_WickersonStudios_BACK_TO_THE_BASICS_(NEW_006)_013.gh (Grasshopper 1.0.7)
# Copyright: bernhard muller bijoutiers
# plug-ins: Bifocals

# https://github.com/mwickerson/PATREON_MEMBERS_ONLY_ghpythonNodeBasics
# gitHub: Mwickerson
# NEW_006 LOOPS
number_slider = Slider(10, range=0..10)
number_slider_2 = Slider(10, range=0..10)
ghpython_script = GhPythonScript(x=number_slider, y=Slider(9, range=0..10), amp=Slider(1, range=0..1), itemNum=Slider(100, range=0..100))  # -> out, pointA_out, i_out, maxCount; inputs x: Int32, y: Int32, itemNum: Int32
# ---------- ghpython_script: Python ----------
#import rhinoscriptsyntax as rs
import Rhino.Geometry as rg
import math

ptsA = []

for i in range(x):
    for j in range(y):
        if x > y:
            vec = rg.Vector3d(i,j,math.sin(amp*i*j))
            ptA = rg.Point3d(vec)
            ptsA.append(ptA)
        elif x == y:
            vec = rg.Vector3d(-i,-j,0)
            ptA = rg.Point3d(vec)
            ptsA.append(ptA)
        else:
            vec = rg.Vector3d(-i,-j,abs(-amp*i*j))
            ptA = rg.Point3d(vec)
            ptsA.append(ptA)

pointA_out = ptsA
#print pointA_out

maxCount = len(ptsA)
print maxCount
if itemNum < maxCount and itemNum % 2 == 0:
    for i in range(maxCount):
        i_out = ptsA[itemNum]
else:
    i_out = ptsA[37]
# ---------- end ghpython_script ----------
ghpython_script_2 = GhPythonScript(x=number_slider_2, y=Slider(8, range=0..10), amp=Slider(0.12, range=0..1))  # -> out, pointA_out, a, b, c, d, e, f, g, h; inputs x: Int32, y: Int32, listItem: Int32, insertPoint: Point3d, insertLocation: Int32, testPoint: Point3d
# ---------- ghpython_script_2: Python ----------
import rhinoscriptsyntax as rs
import Rhino.Geometry as rg
import math

ptsA = []

for i in range(x):
    for j in range(y):
        if x > y:
            vec = rg.Vector3d(i,j,math.sin(amp*i*j))
            ptA = rg.Point3d(vec)
            ptsA.append(ptA)
        elif x == y:
            vec = rg.Vector3d(i,j,0)
            ptA = rg.Point3d(vec)
            ptsA.append(ptA)
        else:
            vec = rg.Vector3d(-i,-j,abs(-amp*i*j))
            ptA = rg.Point3d(vec)
            ptsA.append(ptA)

pointA_out = ptsA
print pointA_out
# ---------- end ghpython_script_2 ----------
panel = Panel(ghpython_script.maxCount)
point = Point(ghpython_script.i_out)
surface_from_points = SurfaceFromPoints(Points=ghpython_script.pointA_out, UCount=number_slider, Interpolate=False)
surface_from_points_2 = SurfaceFromPoints(Points=ghpython_script_2.pointA_out, UCount=number_slider_2, Interpolate=False)
sphere = Sphere(Base=point, Radius=Slider(0.74, range=0..1))
panel_2 = Panel(point)
panel_3 = Panel(ghpython_script.out)
