# Grasshopper definition PATREON_MEMBERSHIP_ONLY_Rhino7_GHPYTHON_WickersonStudios_BACK_TO_THE_BASICS_(NEW_007)_014.gh (Grasshopper 1.0.7)
# Copyright: bernhard muller bijoutiers
# plug-ins: Bifocals

# https://github.com/mwickerson/PATREON_MEMBERS_ONLY_ghpythonNodeBasics
# gitHub: Mwickerson
# NEW_007 FOR  LOOPS
number_slider = Slider(2, range=0..10)  # disabled
# NEW_007 WHILE  LOOPS
number_slider_2 = Slider(7, range=0..10)
range = Range(Domain=Domain(0, 1), Steps=number_slider)  # disabled
ghpython_script = GhPythonScript(x=number_slider_2)  # -> out, a, b; inputs x: Int32
# ---------- ghpython_script: Python ----------
import rhinoscriptsyntax as rs

#WHEN WE DON'T KNOW THE TIME OF THE INTERATION CAUTION!

while x > 2:
    print "I love python"
    break

while x < 10:
    print x, "is smaller than 10"
    x += 1
# ---------- end ghpython_script ----------
ghpython_script_2 = GhPythonScript(x=range)  # -> out, a, b; inputs x: Int32; disabled
# ---------- ghpython_script_2: Python ----------
import rhinoscriptsyntax as rs

#a = x
x = range(1,20,4)
print x
a = x

b = len(a)

for i in range(b):
    print a[3]
# ---------- end ghpython_script_2 ----------
panel = Panel(ghpython_script.out)
panel_2 = Panel(ghpython_script_2.a)  # disabled
panel_4 = Panel(ghpython_script_2.b)  # disabled
panel_5 = Panel(ghpython_script_2.out)  # disabled
