# Grasshopper definition PATREON_MEMBERSHIP_ONLY_Rhino7_GHPYTHON_WickersonStudios_BACK_TO_THE_BASICS_(NEW_008)_015.gh (Grasshopper 1.0.7)
# Copyright: bernhard muller bijoutiers
# plug-ins: Bifocals, Weaverbird

# ----
# NEW_008 RESOURCES
# 
# PYTHON IN EASY STEPS
# 
# HEADFIRST PROGRAMMING
# 
# PYTHON.ORG  DOCS
number_slider = Slider(4, range=0..100)
unit_x = UnitX(Factor=number_slider)
point = Point(<point referenced from the Rhino model>)
panel = Panel("sin(60) = x/l")
panel_2 = Panel("x = sin(60) * l")
move = Move(Geometry=point, Motion=unit_x)  # -> Geometry, Transform

# ----
# NEW_008 FUNCTIONS
number_slider_2 = Slider(22, range=0..100)  # disabled
number_slider_3 = Slider(31, range=0..100)  # disabled
number_slider_4 = Slider(27, range=0..100)  # disabled
number_slider_5 = Slider(2, range=0..10)  # disabled
# https://github.com/mwickerson/PATREON_MEMBERS_ONLY_ghpythonNodeBasics
# gitHub: Mwickerson
# SPECIAL THANKS TO Niloofar Zaker
# link: https://rhino3d.education/p/ghpython-introduction?fbclid=IwAR0QmOPmYIqX3xEZdEPj0Jc5QgnMxvOgR6c4pNX9ESg3vAIExDr7up3QCqA
my_first_function_001 = GhPythonScript()  # -> out, a; disabled
# ---------- my_first_function_001: Python ----------
#1001 FUNCTIONS FROM WICKERSON STUDIOS 2020

import rhinoscriptsyntax as rs

def my_first_function_001():
    print ("Wickerson Studios")

print "Life is Too Beautiful!"
my_first_function_001()
print "Life is Too short!"
# ---------- end my_first_function_001 ----------
panel_3 = Panel(my_first_function_001.out)  # disabled

# ---- group: multi_002
ghpython_script = GhPythonScript(y=number_slider_2)  # -> out, a; inputs y: Int32; disabled
# ---------- ghpython_script: Python ----------
#1001 FUNCTIONS FROM WICKERSON STUDIOS 2020

import rhinoscriptsyntax as rs

def multi_002(x):
    print x*20

multi_002(y)
# ---------- end ghpython_script ----------

# ---- group: odd_even_003
ghpython_script_2 = GhPythonScript(i=number_slider_4, j=number_slider_3)  # -> out, a; inputs i: Int32, j: Int32; disabled
# ---------- ghpython_script_2: Python ----------
import rhinoscriptsyntax as rs

def odd_even_003(i,j):
    if i % 2 ==0 and j % 2 ==0:
        print "i and j are even"
    elif i % 2 != 0 and j % 2 != 0:
        print " i and j are odd numbers"
    elif i % 2 ==0 and j % 2 != 0:
        print "i is even but j is odd"
    #elif i % 2 != 0 and j % 2 == 0:
    else:
        print "i is odd but j is even"

odd_even_003(20,23)

odd_even_003(i, j)
# ---------- end ghpython_script_2 ----------

# ---- group: fibonacci_004
ghpython_script_3 = GhPythonScript(x=number_slider_5)  # -> out, a; inputs x: Int32; disabled
# ---------- ghpython_script_3: Python ----------
import rhinoscriptsyntax as rs

def fibonacci_004(n):
    if n == 0:
        return 0
    if n == 1:
        return 1
    else:
        return fibonacci_004(n - 2) + fibonacci_004(n - 1)

a = fibonacci_004(x)
# ---------- end ghpython_script_3 ----------

# ----
panel_4 = Panel(ghpython_script.out)  # disabled
construct_point = ConstructPoint(XCoordinate=ghpython_script_3.a, YCoordinate=ghpython_script_3.a, ZCoordinate=ghpython_script_3.a)  # disabled
panel_5 = Panel(ghpython_script_3.a)  # disabled
panel_6 = Panel(ghpython_script_2.out)  # disabled

# ----
# NEW_008 POINTS
number_slider_6 = Slider(8, range=0..10)  # disabled
number_slider_7 = Slider(6, range=0..10)  # disabled
number_slider_8 = Slider(3, range=0..10)  # disabled
number_slider_9 = Slider(10, range=0..10)  # disabled
number_slider_10 = Slider(4, range=0..10)  # disabled
number_slider_11 = Slider(5, range=0..10)  # disabled
number_slider_12 = Slider(7, range=0..10)  # disabled
number_slider_13 = Slider(10, range=0..10)  # disabled
number_slider_14 = Slider(0.075, range=0..0.1)  # disabled
number_slider_15 = Slider(20, range=0..100)  # disabled
number_slider_16 = Slider(19, range=0..100)  # disabled
number_slider_17 = Slider(1.5, range=-10..10.01)  # disabled
number_slider_18 = Slider(0.39, range=0..10)  # disabled
point_2 = Point(Point(1.786002098, 0.9211885921, 3.831377675))  # disabled
sphere = Sphere(Base=point_2, Radius=1)  # disabled

# ---- group: Points
ghpython_script_4 = GhPythonScript(x=number_slider_11, y=number_slider_12)  # -> out, points, polyline; inputs x: Int32, y: Int32; disabled
# ---------- ghpython_script_4: Python ----------
#libraries

import rhinoscriptsyntax as rs

points = []
def points_005(x,y):
    for i in range(x):
        for j in range(y):
            b = rs.AddPoint(i, j, 0)
            points.append(b)
    
points_005(x,y)
    
polyline = rs.AddPolyline(points, None)
# ---------- end ghpython_script_4 ----------

# ---- group: polyline_006
ghpython_script_5 = GhPythonScript(x=number_slider_6, y=number_slider_8, z=number_slider_7)  # -> out, pointsA, polyline; inputs x: Int32, y: Int32, z: Int32; disabled
# ---------- ghpython_script_5: Python ----------
import rhinoscriptsyntax as rs

pointsA = []
polyline = []
"""
for j in range(x):
    if j % 2 == 0:
        ptsA = rs.AddPoint(j, y, 0)
    else:
        ptsA = rs.AddPoint(j, y, z)
    pointsA.append(ptsA)

"""

def polyline_006():
    for j in range(x):
        if j % 2 == 0:
            ptsA = rs.AddPoint(j, y, 0)
        else:
            ptsA = rs.AddPoint(j, y, z)
        pointsA.append(ptsA)
        polyline.append(rs.AddPolyline(pointsA))
        
polyline_006()
# ---------- end ghpython_script_5 ----------

# ---- group: Surface_007
ghpython_script_6 = GhPythonScript(x=number_slider_16, y=number_slider_15, v=number_slider_17, n=number_slider_18)  # -> out, a; inputs x: Int32, y: Int32; disabled
# ---------- ghpython_script_6: Python ----------
import rhinoscriptsyntax as rs
import math
a = []
"""
for  i in range(10):
    for j in range(10):
        for k in range(10):
            a.append(rs.AddPoint(i,j,k))
"""
def surface_007():
    for  i in range(x):
        for j in range(y):
            a.append(rs.AddPoint(i,j,(math.sin(i*n)* math.cos(j*n))*v))
            
surface_007()
# ---------- end ghpython_script_6 ----------

# ---- group: attractor_008
ghpython_script_7 = GhPythonScript(attractor=point_2, x=number_slider_10, y=number_slider_10, z=number_slider_10, v=number_slider_14)  # -> out, point, a, sp, dis; inputs attractor: Point3d, x: Int32, y: Int32, z: Int32; disabled
# ---------- ghpython_script_7: Python ----------
import rhinoscriptsyntax as rs

a = []
sp = []
dis = []

def attractor_008():
    for i in range(x):
        for j in range(y):
            for k in range(z):
                point = rs.AddPoint(i,j,k)
                a.append(point)
                dis = rs.Distance(attractor, point)
                sp.append(rs.AddSphere(point, dis * v))
                
attractor_008()
"""

for i in range(x):
    for j in range(y):
        for k in range(z):
            point = rs.AddPoint(i,j,k)
            a.append(point)
            dis = rs.Distance(attractor, point)
            sp.append(rs.AddSphere(point, dis * v))
            
"""
# ---------- end ghpython_script_7 ----------

# ----
curve = Curve(ghpython_script_4.polyline)  # disabled
point_3 = Point(ghpython_script_4.points)  # disabled
point_4 = Point(ghpython_script_6.a)  # disabled
point_5 = Point(ghpython_script_5.pointsA)  # disabled
curve_2 = Curve(ghpython_script_5.polyline)  # disabled
point_6 = Point(ghpython_script_7.a)  # disabled
point_7 = Point(ghpython_script_7.point)  # disabled
panel_7 = Panel(ghpython_script_7.dis)  # disabled
surface_from_points = SurfaceFromPoints(Points=point_4, UCount=number_slider_16, Interpolate=False)  # disabled
geometry = Geometry(ghpython_script_7.sp)  # disabled
delaunay_mesh = DelaunayMesh(Points=point_4, Plane=PlaneXY(0, 0, 0))  # disabled
weaverbird_s_mesh_window = WeaverbirdsMeshWindow(MeshPolylines=delaunay_mesh, Distance=5, InsetType=0)  # disabled
weaverbird_s_stellate_cumulation = WeaverbirdsStellateCumulation(MeshPolylines=delaunay_mesh, Distance=number_slider_17)  # disabled

# ----
# NEW_008 CURVES
number_slider_19 = Slider(4, range=0..4)  # disabled
number_slider_20 = Slider(5, range=0..100)  # disabled
point_8 = Point(Point(-12.86687905, 6.072204481, 0))  # disabled
point_9 = Point(Point(-2.810931272, -4.24085025, 0))  # disabled
curve_3 = Curve(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)  # disabled
curve_4 = Curve(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)  # disabled
curve_5 = Curve(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)  # disabled
number_slider_21 = Slider(247, range=0..360)  # disabled
number_slider_22 = Slider(4, range=0..4)  # disabled
number_slider_23 = Slider(10, range=0..12)  # disabled
point_10 = Point(Point(-1.546227967, -5.175303394, 0))  # disabled
point_11 = Point(Point(-12.42183345, 7.763754086, 0))  # disabled
point_12 = Point(Point(-1.546227967, -5.175303394, 0))
point_13 = Point(Point(-12.42183345, 7.763754086, 0))
number_slider_24 = Slider(176, range=0..360)  # disabled
number_slider_25 = Slider(4, range=0..4)  # disabled
number_slider_26 = Slider(12, range=0..12)  # disabled
point_14 = Point(Point(-1.546227967, -5.175303394, 0))  # disabled
point_15 = Point(Point(-12.42183345, 7.763754086, 0))  # disabled

# ---- group: rectangle_010
ghpython_script_8 = GhPythonScript(pt1=point_9, pt2=point_8, line_amount=number_slider_19)  # -> out, pt3, pt4, ln1, ln2, ln3, ln4, a; inputs pt1: Point3d, pt2: Point3d, line_amount: Int32; disabled
# ---------- ghpython_script_8: Python ----------
import rhinoscriptsyntax as rs

#a = pt1[0]

#pt = (4,5,6)

#pt1 = 
#pt2 =
#pt3 =
#pt4 = 

pt3 = rs.AddPoint(pt1[0],pt2[1],0)
pt4 = rs.AddPoint(pt2[0],pt1[1],0)

#ln1 = rs.AddLine(pt1,pt3)
#ln2 = rs.AddLine(pt2,pt4)
#ln3 = rs.AddLine(pt3,pt2)
#ln4 = rs.AddLine(pt4,pt1)

pts = [pt1,pt3,pt2,pt4,pt1]

a = []
for i in range(line_amount):
    #a = rs.AddLine(pts[i],pts[i+1])
    a.append(rs.AddLine(pts[i],pts[i+1]))
# ---------- end ghpython_script_8 ----------

# ---- group: divide_curve_009
ghpython_script_9 = GhPythonScript(x=number_slider_20, line1=curve_3, line2=curve_4, line3=curve_5)  # -> out, a, b, c, d, ln1, ln2; inputs x: Int32, line1: Curve, line2: Curve, line3: Curve; disabled
# ---------- ghpython_script_9: Python ----------
import rhinoscriptsyntax as rs

a = rs.DivideCurve(line1, x)
b = rs.DivideCurve(line2, x)
c = rs.DivideCurve(line3, x)

#c = rs.AddLine(a[0],b[0])
#d = rs.AddLine(a[4],b[4])

ln1 = []
ln2 = []

def divide_curve_009(x):
    for i in range(x):
            f = rs.AddLine(a[i],b[i])
            g = rs.AddLine(b[i],c[i])
            ln1.append(f)
            ln2.append(g)
            

divide_curve_009(x+1)
# ---------- end ghpython_script_9 ----------

# ---- group: rotation_011
ghpython_script_10 = GhPythonScript(pt1=point_10, pt2=point_11, line_amount=number_slider_22, parameter=number_slider_23, full=number_slider_21)  # -> out, pt3, pt4, ln1, ln2, ln3, ln4, a, b; inputs pt1: Point3d, pt2: Point3d, line_amount: Int32, parameter: Int32, full: Int32; disabled
# ---------- ghpython_script_10: Python ----------
import rhinoscriptsyntax as rs
import math

pt3 = rs.AddPoint(pt1[0],pt2[1],0)
pt4 = rs.AddPoint(pt2[0],pt1[1],0)

pts = [pt1,pt3,pt2,pt4,pt1]

a = []

def rectangle_010():
    for i in range(line_amount):
        #a = rs.AddLine(pts[i],pts[i+1])
        a.append(rs.AddLine(pts[i],pts[i+1])) 

rectangle_010()

b = []
curves = []

def rotation_011():
    for j in range(full):
        curves.append(rs.JoinCurves(a, False, None))
        b.append(rs.RotateObject(curves, pt1, math.degrees(j * (full/parameter)), None, True))

rotation_011()
# ---------- end ghpython_script_10 ----------

# ---- group: rectangle_010
ghpython_script_11 = GhPythonScript(pt1=point_12, pt2=point_13, line_amount=Slider(4, range=0..4))  # -> out, pt3, pt4, ln1, ln2, ln3, ln4, a; inputs pt1: Point3d, pt2: Point3d, line_amount: Int32
# ---------- ghpython_script_11: Python ----------
import rhinoscriptsyntax as rs

pt3 = rs.AddPoint(pt1[0],pt2[1],0)
pt4 = rs.AddPoint(pt2[0],pt1[1],0)

pts = [pt1,pt3,pt2,pt4,pt1]

a = []

def rectangle_010():
    for i in range(line_amount):
        #a = rs.AddLine(pts[i],pts[i+1])
        a.append(rs.AddLine(pts[i],pts[i+1])) 

rectangle_010()
# ---------- end ghpython_script_11 ----------

# ---- group: rotation_011
ghpython_script_12 = GhPythonScript(pt1=point_14, pt2=point_15, line_amount=number_slider_25, parameter=number_slider_26, full=number_slider_24)  # -> out, pt3, pt4, ln1, ln2, ln3, ln4, a, b; inputs pt1: Point3d, pt2: Point3d, line_amount: Int32, parameter: Int32, full: Int32; disabled
# ---------- ghpython_script_12: Python ----------
import rhinoscriptsyntax as rs
import math

pt3 = rs.AddPoint(pt1[0],pt2[1],0)
pt4 = rs.AddPoint(pt2[0],pt1[1],0)

pts = [pt1,pt3,pt2,pt4,pt1]

a = []

def rectangle_010():
    for i in range(line_amount):
        #a = rs.AddLine(pts[i],pts[i+1])
        a.append(rs.AddLine(pts[i],pts[i+1])) 

rectangle_010()

b = []
curves = []

def rotation_011():
#def rotation_011(full,parameter):
    for j in range(full):
        curves.append(rs.JoinCurves(a, False, None))
        b.append(rs.RotateObject(curves, pt1, math.degrees(j * (full/parameter)), None, True))

rotation_011()
#rotation_011(full,parameter)
# ---------- end ghpython_script_12 ----------

# ----
point_16 = Point(ghpython_script_9.a)  # disabled
curve_6 = Curve(ghpython_script_9.ln1)  # disabled
curve_7 = Curve(ghpython_script_9.ln2)  # disabled
panel_8 = Panel(ghpython_script_8.ln1)  # disabled
panel_9 = Panel(ghpython_script_8.ln2)  # disabled
panel_10 = Panel(ghpython_script_8.ln3)  # disabled
panel_11 = Panel(ghpython_script_8.ln4)  # disabled
panel_12 = Panel(point_16)
panel_13 = Panel(ghpython_script_10.ln4)  # disabled
panel_14 = Panel(ghpython_script_10.ln1)  # disabled
panel_15 = Panel(ghpython_script_10.ln3)  # disabled
panel_16 = Panel(ghpython_script_10.ln2)  # disabled
panel_17 = Panel(ghpython_script_11.ln1)
panel_18 = Panel(ghpython_script_11.ln2)
panel_19 = Panel(ghpython_script_11.ln3)
panel_20 = Panel(ghpython_script_11.ln4)
curve_8 = Curve(ghpython_script_12.a)  # disabled
curve_9 = Curve(ghpython_script_12.b)  # disabled

# ----
# NEW_008 GEOMETRIES
number_slider_27 = Slider(40, range=0..100)  # disabled
surface = Surface(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)  # disabled
populate_geometry = PopulateGeometry(Geometry=surface, Count=number_slider_27, Seed=1)  # disabled
number_slider_28 = Slider(24, range=0..100)  # disabled
polygon = Polygon(Plane=PlaneXY(0, 0, 0), Radius=3, Segments="3", FilletRadius=0)  # -> Polygon, Length
deconstruct_brep = DeconstructBrep(Brep=polygon.Polygon)  # -> Faces, Edges, Vertices
number_slider_29 = Slider(100, range=0..100)
list_item = ListItem(List=deconstruct_brep.Vertices, Index=0, Wrap=True)  # -> Item, Item1, Item2
point_17 = Point(list_item.Item)
point_18 = Point(list_item.Item1)
point_19 = Point(list_item.Item2)
panel_21 = Panel("4")  # disabled

# ---- group: random_012
ghpython_script_13 = GhPythonScript(seed=number_slider_28)  # -> out, a, b, c, d, e; inputs seed: Int32; disabled
# ---------- ghpython_script_13: Python ----------
import rhinoscriptsyntax as rs
import random

#random.seed(seed)

a = random.random()

b = random.uniform(1,50)

c = random.randrange(100, 300, 10)

d = random.choice("Wickerson")

list = [5,6,7,8,9]

e = random.randint(120, 1200)
# ---------- end ghpython_script_13 ----------

# ---- group: spiral_013
ghpython_script_14 = GhPythonScript(
    num=Slider(13, range=0..100),
    v=Slider(100, range=0..100),
    n=Slider(2, range=0..10),
    m=Slider(0.448, range=0..10),
    Xstretch=Slider(7.26, range=0..10),
    Ystretch=Slider(0.91, range=0..10))  # -> out, a; inputs num: Int32, v: Int32
# ---------- ghpython_script_14: Python ----------
import rhinoscriptsyntax as rs
import math

a = []

def spiral_013():
    for i in range(num):
        x = math.cos(i*n) * i * (n + Xstretch)
        y = math.sin(i*n) * i * (n + Ystretch)
        
        if (i < v):
            z = i * n/m
        p = rs.AddPoint(x,y,z)
        a.append(p)

spiral_013()
# ---------- end ghpython_script_14 ----------

# ---- group: koch_014
ghpython_script_15 = GhPythonScript(x=point_17, y=point_19, z=point_18, div=Slider(2, range=0..10), it=Slider(2, range=0..5))  # -> out, a; inputs x: Point3d, y: Point3d, z: Point3d, div: Int32, it: Int32
# ---------- ghpython_script_15: Python ----------
import rhinoscriptsyntax as rs
import math

klines = [rs.AddLine(x,y), rs.AddLine(y,z), rs.AddLine(z,x)]

def normal_vec(v):
    sPt = rs.CurveStartPoint(v)
    ePt = rs.CurveEndPoint(v)
    midx = ePt[0] - sPt[0]
    midy = ePt[1] - sPt[1]
    vector = [-midy, midx, 0]
    return rs.VectorUnitize(vector)

def koch_014(linelist, it):
    sample_ln = linelist[:]
    lines = []
    
    if it == 0:
        return sample_ln
    else:
        for i in sample_ln:
            length = rs.CurveLength(i)
            midpt = rs.CurveMidPoint(i)
            pts = rs.DivideCurve(i, div)
            vector = normal_vec(i)
            h = math.sin(math.pi/3) * length/div
            pts.insert(2, rs.MoveObject(midpt, vector * h))
            segment = rs.ExplodeCurves(rs.AddPolyline(pts))
            lines += segment
    it -= 1
    
    return koch_014(lines, it)

a = koch_014(klines, it)
# ---------- end ghpython_script_15 ----------

# ----
panel_22 = Panel([ghpython_script_13.a, ghpython_script_13.b, ghpython_script_13.c, ghpython_script_13.d, ghpython_script_13.e])  # disabled
nurbs_curve = NurbsCurve(Vertices=ghpython_script_14.a, Degree=3, Periodic=False)  # -> Curve, Length, Domain
interpolate = Interpolate(Vertices=ghpython_script_14.a, Degree=3, Periodic=False, KnotStyle=1)  # -> Curve, Length, Domain
list_item_2 = ListItem(List=populate_geometry, Index=ghpython_script_13.b, Wrap=True)  # disabled
point_20 = Point(list_item_2)  # disabled
divide_curve = DivideCurve(Curve=interpolate.Curve, Count=number_slider_29, Kinks=False)  # -> Points, Tangents, Parameters
divide_curve_2 = DivideCurve(Curve=nurbs_curve.Curve, Count=number_slider_29, Kinks=False)  # -> Points, Tangents, Parameters
sphere_2 = Sphere(Base=point_20, Radius=panel_21)  # disabled
curve_10 = Curve(ghpython_script_15.a)
line = Line(StartPoint=divide_curve_2.Points, EndPoint=divide_curve.Points)
pipe = Pipe(Curve=[line, nurbs_curve.Curve, interpolate.Curve], Radius=Slider(1.34, range=0..10), Caps=0)
