# Grasshopper definition PATREON_MEMBERSHIP_ONLY_Rhino7_GHPYTHON_WickersonStudios_BACK_TO_THE_BASICS_(Number_Slider_Input)_002.gh (Grasshopper 1.0.7)
# Copyright: bernhard muller bijoutiers
# plug-ins: Workshop, Bifocals

# https://github.com/mwickerson/PATREON_MEMBERS_ONLY_ghpythonNodeBasics
# gitHub: Mwickerson
wickerson_s_first_grasshopper_component = WickersonsFirstGrasshopperComponent()  # disabled
gene_pool = GenePool(
    Decimals=0,
    Maximum=10,
    Minimum=0,
    Value=[9.507156238, 5.887724113, 3.547543131, 6.016247015, 0.1450494678, 2.626202378, 6.432432619, 6.956543614, 2.522119564, 3.800484824])
# ARRAY OF POINT
gene_pool_2 = GenePool(
    Decimals=0,
    Maximum=10,
    Minimum=0,
    Value=[5.515572617, 5.945069386, 0, 4.200606144, 2.151893968, 5.377095476, 0.03826524322, 4.029150849, 8.717986821, 2.354797237])
construct_point = ConstructPoint(XCoordinate=0, YCoordinate=0, ZCoordinate=0)
move = Move(Geometry=construct_point, Motion=Vector(0, 0, 10))  # -> Geometry, Transform
ghpython_script = GhPythonScript(x=gene_pool_2, y=gene_pool)  # -> out, pointA_out, pointB_out; inputs x: Int32, y: Int32
# ---------- ghpython_script: Python ----------
import rhinoscriptsyntax as rs
import Rhino.Geometry as rg

for i in range(x):
    for j in range(y):
        pointA = rg.Point3d(i,j,0)
        pointB = rs.AddPoint(0,i,i*j)

pointA_out = pointA
pointB_out = pointB
# ---------- end ghpython_script ----------
line = Line(StartPoint=construct_point, EndPoint=move.Geometry)
line_2 = Line(StartPoint=ghpython_script.pointA_out, EndPoint=ghpython_script.pointB_out)
number_slider = Slider(2, range=0..2)
revolution = Revolution(Curve=line_2, Axis=line, Domain=Domain(0, 6.283185307))  # -> flatten(Surface)
list_length = ListLength(List=revolution)
range = Range(Domain=Slider(3.7, range=0..10), Steps=expr("x-1", list_length))
pi = Pi(Factor=range)
xz_plane = XZPlane(Origin=Point(0, 0, 0))
yz_plane = YZPlane(Origin=Point(0, 0, 0))
rotate = Rotate(Geometry=revolution, Angle=pi, Plane=xz_plane)  # -> Geometry, Transform
cap_holes = CapHoles(Brep=rotate.Geometry)
solid_union = SolidUnion(Breps=cap_holes)
