# Grasshopper definition PATREON_MEMBERSHIP_ONLY_Rhino7_GHPYTHON_WickersonStudios_BACK_TO_THE_BASICS_(Play)_007.gh (Grasshopper 1.0.7)
# Copyright: bernhard muller bijoutiers
# plug-ins: Workshop

wickerson_s_first_grasshopper_component = WickersonsFirstGrasshopperComponent()
number_slider = Slider(4.515, range=0..10)
series = Series(Start=Slider(6.5, range=0..10), Step=Slider(1.521, range=0.001..10), Count=number_slider)
multiplication = Multiplication(A=series, B=number_slider)
division = Division(A=series, B=number_slider)
ghpython_script = GhPythonScript(
    a=Slider(3.196, range=0..10),
    b=Slider(0, range=0..10),
    x=division,
    y=series,
    exp=Slider(2, range=0..10),
    mirror=Slider(0.62, range=0..10))  # -> out, y_listup_out, y_listdown_out; inputs x: list, y: list, exp: Int32
# ---------- ghpython_script: Python ----------
import rhinoscriptsyntax as rs
import math

y_listup = []
y_listdown = []

for i in x:
    y = math.sqrt(((i**exp)+(a*i)+b))
    y_listup.append(y)
    y_listdown.append(y*-mirror)

print(y_listup, y_listdown)

y_listup_out = y_listup
y_listdown_out = y_listdown
# ---------- end ghpython_script ----------
panel = Panel(ghpython_script.y_listdown_out)
panel_2 = Panel(ghpython_script.out)
panel_3 = Panel(ghpython_script.y_listup_out)
construct_point = ConstructPoint(XCoordinate=panel_3, YCoordinate=panel_3, ZCoordinate=panel_3)
construct_point_2 = ConstructPoint(XCoordinate=0, YCoordinate=panel, ZCoordinate=panel)
construct_point_3 = ConstructPoint(XCoordinate=0, YCoordinate=0, ZCoordinate=0)
unit_z = UnitZ(Factor=1)
interpolate = Interpolate(Vertices=[construct_point, construct_point_2], Degree=3, Periodic=False, KnotStyle=1)  # -> Curve, Length, Domain
line_sdl = LineSDL(Start=construct_point_3, Direction=unit_z, Length=1)
param_viewer = ParamViewer(ghpython_script.out)
revolution = Revolution(Curve=interpolate.Curve, Axis=line_sdl, Domain=Domain(0, 6.283185307))
cap_holes = CapHoles(Brep=revolution)
