# Grasshopper definition PATREON_MEMBERSHIP_ONLY_Rhino7_GHPYTHON_WickersonStudios_BACK_TO_THE_BASICS_(Ramdom)_006.gh (Grasshopper 1.0.7)
# Copyright: bernhard muller bijoutiers
# plug-ins: Workshop, Bifocals

# https://github.com/mwickerson/PATREON_MEMBERS_ONLY_ghpythonNodeBasics
# gitHub: Mwickerson
# RANDOM
wickerson_s_first_grasshopper_component = WickersonsFirstGrasshopperComponent()  # disabled
ghpython_script = GhPythonScript(x=Slider(10, range=0..100), y=Slider(18, range=0..100))  # -> out, randomA_out, randomB_out, randomC_out; inputs x: Int32, y: Int32
# ---------- ghpython_script: Python ----------
import random as r

randomA = r.random()
randomB = r.randint(x,100)
randomC = r.uniform(y,100)

randomA_out = randomA
randomB_out = randomB
randomC_out = randomC
# ---------- end ghpython_script ----------
panel = Panel(ghpython_script.randomC_out)
panel_2 = Panel(ghpython_script.randomA_out)
panel_3 = Panel(ghpython_script.randomB_out)
series = Series(Start=panel_2, Step=panel, Count=panel_3)
circle = Circle(Plane=PlaneXY(0, 0, 0), Radius=series)
curve = Curve(reparameterize(circle))
construct_domain = ConstructDomain(DomainStart=Slider(0, range=0..100), DomainEnd=Slider(4.23, range=0..10))
list_length = ListLength(List=circle)
list_length_2 = ListLength(List=curve)
range = Range(Domain=Slider(1, range=0..1), Steps=expr("x-1", list_length_2))
construct_point = ConstructPoint(XCoordinate=0, YCoordinate=0, ZCoordinate=0)
range_2 = Range(Domain=construct_domain, Steps=expr("x-1", list_length))
unit_x = UnitX(Factor=1)
evaluate_curve = EvaluateCurve(Curve=reparameterize(circle), Parameter=range)  # -> Point, Tangent, Angle
pi = Pi(Factor=range_2)
line_sdl = LineSDL(Start=construct_point, Direction=unit_x, Length=Slider(100, range=0..100))
rotate_3d = Rotate3D(Geometry=circle, Angle=pi, Center=evaluate_curve.Point, Axis=line_sdl)  # -> Geometry, Transform
pipe = Pipe(Curve=rotate_3d.Geometry, Radius=Slider(200, range=0..200), Caps=0)
