# Grasshopper definition PATREON_MEMBERSHIP_ONLY_Rhino7_GHPYTHON_WickersonStudios_GEOMETRIC_APPLICATIONS_(NEW_009_016.gh (Grasshopper 1.0.7)
# Copyright: bernhard muller bijoutiers
# plug-ins: Bifocals, Weaverbird, MeshEdit Components

# ----
# NEW_008 RESOURCES
# 
# PYTHON IN EASY STEPS
# 
# HEADFIRST PROGRAMMING
# 
# PYTHON.ORG  DOCS
number_slider = Slider(4, range=0..100)  # disabled
unit_x = UnitX(Factor=number_slider)  # disabled
point = Point(<point referenced from the Rhino model>)  # disabled
panel = Panel("sin(60) = x/l")  # disabled
panel_2 = Panel("x = sin(60) * l")  # disabled
move = Move(Geometry=point, Motion=unit_x)  # -> Geometry, Transform; disabled

number_slider_2 = Slider(4, range=0..100)  # disabled
unit_x_2 = UnitX(Factor=number_slider_2)  # disabled
point_2 = Point(<point referenced from the Rhino model>)  # disabled
move_2 = Move(Geometry=point_2, Motion=unit_x_2)  # -> Geometry, Transform; disabled

# ----
# NEW_008 POINTS
number_slider_3 = Slider(8, range=0..10)  # disabled
number_slider_4 = Slider(6, range=0..10)  # disabled
number_slider_5 = Slider(3, range=0..10)  # disabled
number_slider_6 = Slider(10, range=0..10)  # disabled
number_slider_7 = Slider(5, range=0..10)  # disabled
number_slider_8 = Slider(4, range=0..10)  # disabled
number_slider_9 = Slider(7, range=0..10)  # disabled
number_slider_10 = Slider(10, range=0..10)  # disabled
number_slider_11 = Slider(0.075, range=0..0.1)  # disabled
number_slider_12 = Slider(20, range=0..100)  # disabled
number_slider_13 = Slider(19, range=0..100)  # disabled
number_slider_14 = Slider(1.5, range=-10..10.01)  # disabled
number_slider_15 = Slider(0.39, range=0..10)  # disabled
point_3 = Point(Point(1.786002098, 0.9211885921, 3.831377675))  # disabled
sphere = Sphere(Base=point_3, Radius=1)  # disabled

# ---- group: Points
ghpython_script = GhPythonScript(x=number_slider_7, y=number_slider_9)  # -> out, points, polyline; inputs x: Int32, y: Int32; disabled
# ---------- ghpython_script: Python ----------
#libraries

import rhinoscriptsyntax as rs

points = []
def points_005(x,y):
    for i in range(x):
        for j in range(y):
            b = rs.AddPoint(i, j, 0)
            points.append(b)
    
points_005(x,y)
    
polyline = rs.AddPolyline(points, None)
# ---------- end ghpython_script ----------

# ---- group: polyline_006
ghpython_script_2 = GhPythonScript(x=number_slider_3, y=number_slider_5, z=number_slider_4)  # -> out, pointsA, polyline; inputs x: Int32, y: Int32, z: Int32; disabled
# ---------- ghpython_script_2: Python ----------
import rhinoscriptsyntax as rs

pointsA = []
polyline = []
"""
for j in range(x):
    if j % 2 == 0:
        ptsA = rs.AddPoint(j, y, 0)
    else:
        ptsA = rs.AddPoint(j, y, z)
    pointsA.append(ptsA)

"""

def polyline_006():
    for j in range(x):
        if j % 2 == 0:
            ptsA = rs.AddPoint(j, y, 0)
        else:
            ptsA = rs.AddPoint(j, y, z)
        pointsA.append(ptsA)
        polyline.append(rs.AddPolyline(pointsA))
        
polyline_006()
# ---------- end ghpython_script_2 ----------

# ---- group: Surface_007
ghpython_script_3 = GhPythonScript(x=number_slider_13, y=number_slider_12, v=number_slider_14, n=number_slider_15)  # -> out, a; inputs x: Int32, y: Int32; disabled
# ---------- ghpython_script_3: Python ----------
import rhinoscriptsyntax as rs
import math
a = []
"""
for  i in range(10):
    for j in range(10):
        for k in range(10):
            a.append(rs.AddPoint(i,j,k))
"""
def surface_007():
    for  i in range(x):
        for j in range(y):
            a.append(rs.AddPoint(i,j,(math.sin(i*n)* math.cos(j*n))*v))
            
surface_007()
# ---------- end ghpython_script_3 ----------

# ---- group: attractor_008
ghpython_script_4 = GhPythonScript(attractor=point_3, x=number_slider_8, y=number_slider_8, z=number_slider_8, v=number_slider_11)  # -> out, point, a, sp, dis; inputs attractor: Point3d, x: Int32, y: Int32, z: Int32; disabled
# ---------- ghpython_script_4: Python ----------
import rhinoscriptsyntax as rs

a = []
sp = []
dis = []

def attractor_008():
    for i in range(x):
        for j in range(y):
            for k in range(z):
                point = rs.AddPoint(i,j,k)
                a.append(point)
                dis = rs.Distance(attractor, point)
                sp.append(rs.AddSphere(point, dis * v))
                
attractor_008()
"""

for i in range(x):
    for j in range(y):
        for k in range(z):
            point = rs.AddPoint(i,j,k)
            a.append(point)
            dis = rs.Distance(attractor, point)
            sp.append(rs.AddSphere(point, dis * v))
            
"""
# ---------- end ghpython_script_4 ----------

# ----
curve = Curve(ghpython_script.polyline)  # disabled
point_4 = Point(ghpython_script.points)  # disabled
point_5 = Point(ghpython_script_3.a)  # disabled
point_6 = Point(ghpython_script_2.pointsA)  # disabled
curve_2 = Curve(ghpython_script_2.polyline)  # disabled
point_7 = Point(ghpython_script_4.a)  # disabled
point_8 = Point(ghpython_script_4.point)  # disabled
panel_5 = Panel(ghpython_script_4.dis)  # disabled
surface_from_points = SurfaceFromPoints(Points=point_5, UCount=number_slider_13, Interpolate=False)  # disabled
geometry = Geometry(ghpython_script_4.sp)  # disabled
delaunay_mesh = DelaunayMesh(Points=point_5, Plane=PlaneXY(0, 0, 0))  # disabled
weaverbird_s_mesh_window = WeaverbirdsMeshWindow(MeshPolylines=delaunay_mesh, Distance=5, InsetType=0)  # disabled
weaverbird_s_stellate_cumulation = WeaverbirdsStellateCumulation(MeshPolylines=delaunay_mesh, Distance=number_slider_14)  # disabled

# ----
# NEW_008 FUNCTIONS
number_slider_16 = Slider(22, range=0..100)  # disabled
number_slider_17 = Slider(31, range=0..100)  # disabled
number_slider_18 = Slider(27, range=0..100)  # disabled
number_slider_19 = Slider(2, range=0..10)  # disabled
# https://github.com/mwickerson/PATREON_MEMBERS_ONLY_ghpythonNodeBasics
# gitHub: Mwickerson
# SPECIAL THANKS TO Niloofar Zaker
# link: https://rhino3d.education/p/ghpython-introduction?fbclid=IwAR0QmOPmYIqX3xEZdEPj0Jc5QgnMxvOgR6c4pNX9ESg3vAIExDr7up3QCqA
my_first_function_001 = GhPythonScript()  # -> out, a; disabled
# ---------- my_first_function_001: Python ----------
#1001 FUNCTIONS FROM WICKERSON STUDIOS 2020

import rhinoscriptsyntax as rs

def my_first_function_001():
    print ("Wickerson Studios")

print "Life is Too Beautiful!"
my_first_function_001()
print "Life is Too short!"
# ---------- end my_first_function_001 ----------
panel_6 = Panel(my_first_function_001.out)  # disabled

# ---- group: multi_002
ghpython_script_5 = GhPythonScript(y=number_slider_16)  # -> out, a; inputs y: Int32; disabled
# ---------- ghpython_script_5: Python ----------
#1001 FUNCTIONS FROM WICKERSON STUDIOS 2020

import rhinoscriptsyntax as rs

def multi_002(x):
    print x*20

multi_002(y)
# ---------- end ghpython_script_5 ----------

# ---- group: odd_even_003
ghpython_script_6 = GhPythonScript(i=number_slider_18, j=number_slider_17)  # -> out, a; inputs i: Int32, j: Int32; disabled
# ---------- ghpython_script_6: Python ----------
import rhinoscriptsyntax as rs

def odd_even_003(i,j):
    if i % 2 ==0 and j % 2 ==0:
        print "i and j are even"
    elif i % 2 != 0 and j % 2 != 0:
        print " i and j are odd numbers"
    elif i % 2 ==0 and j % 2 != 0:
        print "i is even but j is odd"
    #elif i % 2 != 0 and j % 2 == 0:
    else:
        print "i is odd but j is even"

odd_even_003(20,23)

odd_even_003(i, j)
# ---------- end ghpython_script_6 ----------

# ---- group: fibonacci_004
ghpython_script_7 = GhPythonScript(x=number_slider_19)  # -> out, a; inputs x: Int32; disabled
# ---------- ghpython_script_7: Python ----------
import rhinoscriptsyntax as rs

def fibonacci_004(n):
    if n == 0:
        return 0
    if n == 1:
        return 1
    else:
        return fibonacci_004(n - 2) + fibonacci_004(n - 1)

a = fibonacci_004(x)
# ---------- end ghpython_script_7 ----------

# ----
panel_7 = Panel(ghpython_script_5.out)  # disabled
construct_point = ConstructPoint(XCoordinate=ghpython_script_7.a, YCoordinate=ghpython_script_7.a, ZCoordinate=ghpython_script_7.a)  # disabled
panel_8 = Panel(ghpython_script_7.a)  # disabled
panel_9 = Panel(ghpython_script_6.out)  # disabled

# ----
# NEW_008 CURVES
number_slider_20 = Slider(4, range=0..4)  # disabled
number_slider_21 = Slider(5, range=0..100)  # disabled
point_9 = Point(Point(-12.86687905, 6.072204481, 0))  # disabled
point_10 = Point(Point(-2.810931272, -4.24085025, 0))  # disabled
curve_3 = Curve(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)  # disabled
curve_4 = Curve(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)  # disabled
curve_5 = Curve(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)  # disabled
number_slider_22 = Slider(247, range=0..360)  # disabled
number_slider_23 = Slider(4, range=0..4)  # disabled
number_slider_24 = Slider(10, range=0..12)  # disabled
point_11 = Point(Point(-1.546227967, -5.175303394, 0))  # disabled
point_12 = Point(Point(-12.42183345, 7.763754086, 0))  # disabled
number_slider_25 = Slider(4, range=0..4)  # disabled
point_13 = Point(Point(-1.546227967, -5.175303394, 0))  # disabled
point_14 = Point(Point(-12.42183345, 7.763754086, 0))  # disabled
number_slider_26 = Slider(176, range=0..360)  # disabled
number_slider_27 = Slider(4, range=0..4)  # disabled
number_slider_28 = Slider(12, range=0..12)  # disabled
point_15 = Point(Point(-1.546227967, -5.175303394, 0))  # disabled
point_16 = Point(Point(-12.42183345, 7.763754086, 0))  # disabled

# ---- group: rectangle_010
ghpython_script_8 = GhPythonScript(pt1=point_10, pt2=point_9, line_amount=number_slider_20)  # -> out, pt3, pt4, ln1, ln2, ln3, ln4, a; inputs pt1: Point3d, pt2: Point3d, line_amount: Int32; disabled
# ---------- ghpython_script_8: Python ----------
import rhinoscriptsyntax as rs

#a = pt1[0]

#pt = (4,5,6)

#pt1 = 
#pt2 =
#pt3 =
#pt4 = 

pt3 = rs.AddPoint(pt1[0],pt2[1],0)
pt4 = rs.AddPoint(pt2[0],pt1[1],0)

#ln1 = rs.AddLine(pt1,pt3)
#ln2 = rs.AddLine(pt2,pt4)
#ln3 = rs.AddLine(pt3,pt2)
#ln4 = rs.AddLine(pt4,pt1)

pts = [pt1,pt3,pt2,pt4,pt1]

a = []
for i in range(line_amount):
    #a = rs.AddLine(pts[i],pts[i+1])
    a.append(rs.AddLine(pts[i],pts[i+1]))
# ---------- end ghpython_script_8 ----------

# ---- group: divide_curve_009
ghpython_script_9 = GhPythonScript(x=number_slider_21, line1=curve_3, line2=curve_4, line3=curve_5)  # -> out, a, b, c, d, ln1, ln2; inputs x: Int32, line1: Curve, line2: Curve, line3: Curve; disabled
# ---------- ghpython_script_9: Python ----------
import rhinoscriptsyntax as rs

a = rs.DivideCurve(line1, x)
b = rs.DivideCurve(line2, x)
c = rs.DivideCurve(line3, x)

#c = rs.AddLine(a[0],b[0])
#d = rs.AddLine(a[4],b[4])

ln1 = []
ln2 = []

def divide_curve_009(x):
    for i in range(x):
            f = rs.AddLine(a[i],b[i])
            g = rs.AddLine(b[i],c[i])
            ln1.append(f)
            ln2.append(g)
            

divide_curve_009(x+1)
# ---------- end ghpython_script_9 ----------

# ---- group: rotation_011
ghpython_script_10 = GhPythonScript(pt1=point_11, pt2=point_12, line_amount=number_slider_23, parameter=number_slider_24, full=number_slider_22)  # -> out, pt3, pt4, ln1, ln2, ln3, ln4, a, b; inputs pt1: Point3d, pt2: Point3d, line_amount: Int32, parameter: Int32, full: Int32; disabled
# ---------- ghpython_script_10: Python ----------
import rhinoscriptsyntax as rs
import math

pt3 = rs.AddPoint(pt1[0],pt2[1],0)
pt4 = rs.AddPoint(pt2[0],pt1[1],0)

pts = [pt1,pt3,pt2,pt4,pt1]

a = []

def rectangle_010():
    for i in range(line_amount):
        #a = rs.AddLine(pts[i],pts[i+1])
        a.append(rs.AddLine(pts[i],pts[i+1])) 

rectangle_010()

b = []
curves = []

def rotation_011():
    for j in range(full):
        curves.append(rs.JoinCurves(a, False, None))
        b.append(rs.RotateObject(curves, pt1, math.degrees(j * (full/parameter)), None, True))

rotation_011()
# ---------- end ghpython_script_10 ----------

# ---- group: rectangle_010
ghpython_script_11 = GhPythonScript(pt1=point_13, pt2=point_14, line_amount=number_slider_25)  # -> out, pt3, pt4, ln1, ln2, ln3, ln4, a; inputs pt1: Point3d, pt2: Point3d, line_amount: Int32; disabled
# ---------- ghpython_script_11: Python ----------
import rhinoscriptsyntax as rs

pt3 = rs.AddPoint(pt1[0],pt2[1],0)
pt4 = rs.AddPoint(pt2[0],pt1[1],0)

pts = [pt1,pt3,pt2,pt4,pt1]

a = []

def rectangle_010():
    for i in range(line_amount):
        #a = rs.AddLine(pts[i],pts[i+1])
        a.append(rs.AddLine(pts[i],pts[i+1])) 

rectangle_010()
# ---------- end ghpython_script_11 ----------

# ---- group: rotation_011
ghpython_script_12 = GhPythonScript(pt1=point_15, pt2=point_16, line_amount=number_slider_27, parameter=number_slider_28, full=number_slider_26)  # -> out, pt3, pt4, ln1, ln2, ln3, ln4, a, b; inputs pt1: Point3d, pt2: Point3d, line_amount: Int32, parameter: Int32, full: Int32; disabled
# ---------- ghpython_script_12: Python ----------
import rhinoscriptsyntax as rs
import math

pt3 = rs.AddPoint(pt1[0],pt2[1],0)
pt4 = rs.AddPoint(pt2[0],pt1[1],0)

pts = [pt1,pt3,pt2,pt4,pt1]

a = []

def rectangle_010():
    for i in range(line_amount):
        #a = rs.AddLine(pts[i],pts[i+1])
        a.append(rs.AddLine(pts[i],pts[i+1])) 

rectangle_010()

b = []
curves = []

def rotation_011():
#def rotation_011(full,parameter):
    for j in range(full):
        curves.append(rs.JoinCurves(a, False, None))
        b.append(rs.RotateObject(curves, pt1, math.degrees(j * (full/parameter)), None, True))

rotation_011()
#rotation_011(full,parameter)
# ---------- end ghpython_script_12 ----------

# ----
point_17 = Point(ghpython_script_9.a)  # disabled
curve_6 = Curve(ghpython_script_9.ln1)  # disabled
curve_7 = Curve(ghpython_script_9.ln2)  # disabled
panel_10 = Panel(ghpython_script_8.ln1)  # disabled
panel_11 = Panel(ghpython_script_8.ln2)  # disabled
panel_12 = Panel(ghpython_script_8.ln3)  # disabled
panel_13 = Panel(ghpython_script_8.ln4)  # disabled
panel_14 = Panel(point_17)  # disabled
panel_15 = Panel(ghpython_script_10.ln4)  # disabled
panel_16 = Panel(ghpython_script_10.ln1)  # disabled
panel_17 = Panel(ghpython_script_10.ln3)  # disabled
panel_18 = Panel(ghpython_script_10.ln2)  # disabled
panel_19 = Panel(ghpython_script_11.ln1)  # disabled
panel_20 = Panel(ghpython_script_11.ln2)  # disabled
panel_21 = Panel(ghpython_script_11.ln3)  # disabled
panel_22 = Panel(ghpython_script_11.ln4)  # disabled
curve_8 = Curve(ghpython_script_12.a)  # disabled
curve_9 = Curve(ghpython_script_12.b)  # disabled

# ----
# NEW_008 GEOMETRIES
number_slider_29 = Slider(40, range=0..100)  # disabled
surface = Surface(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)  # disabled
panel_23 = Panel("3")  # disabled
populate_geometry = PopulateGeometry(Geometry=surface, Count=number_slider_29, Seed=1)  # disabled
number_slider_30 = Slider(7.26, range=0..10)  # disabled
number_slider_31 = Slider(0.91, range=0..10)  # disabled
number_slider_32 = Slider(100, range=0..100)  # disabled
number_slider_33 = Slider(2, range=0..10)  # disabled
number_slider_34 = Slider(0.448, range=0..10)  # disabled
number_slider_35 = Slider(13, range=0..100)  # disabled
number_slider_36 = Slider(24, range=0..100)  # disabled
polygon = Polygon(Plane=PlaneXY(0, 0, 0), Radius=3, Segments=panel_23, FilletRadius=0)  # -> Polygon, Length; disabled
deconstruct_brep = DeconstructBrep(Brep=polygon.Polygon)  # -> Faces, Edges, Vertices; disabled
number_slider_37 = Slider(100, range=0..100)  # disabled
list_item = ListItem(List=deconstruct_brep.Vertices, Index=0, Wrap=True)  # -> Item, Item1, Item2; disabled
number_slider_38 = Slider(2, range=0..10)  # disabled
number_slider_39 = Slider(2, range=0..5)  # disabled
point_18 = Point(list_item.Item)  # disabled
point_19 = Point(list_item.Item1)  # disabled
point_20 = Point(list_item.Item2)  # disabled
panel_24 = Panel("4")  # disabled
number_slider_40 = Slider(1.34, range=0..10)  # disabled

# ---- group: random_012
ghpython_script_13 = GhPythonScript(seed=number_slider_36)  # -> out, a, b, c, d, e; inputs seed: Int32; disabled
# ---------- ghpython_script_13: Python ----------
import rhinoscriptsyntax as rs
import random

#random.seed(seed)

a = random.random()

b = random.uniform(1,50)

c = random.randrange(100, 300, 10)

d = random.choice("Wickerson")

list = [5,6,7,8,9]

e = random.randint(120, 1200)
# ---------- end ghpython_script_13 ----------

# ---- group: spiral_013
ghpython_script_14 = GhPythonScript(
    num=number_slider_35,
    v=number_slider_32,
    n=number_slider_33,
    m=number_slider_34,
    Xstretch=number_slider_30,
    Ystretch=number_slider_31)  # -> out, a; inputs num: Int32, v: Int32; disabled
# ---------- ghpython_script_14: Python ----------
import rhinoscriptsyntax as rs
import math

a = []

def spiral_013():
    for i in range(num):
        x = math.cos(i*n) * i * (n + Xstretch)
        y = math.sin(i*n) * i * (n + Ystretch)
        
        if (i < v):
            z = i * n/m
        p = rs.AddPoint(x,y,z)
        a.append(p)

spiral_013()
# ---------- end ghpython_script_14 ----------

# ---- group: koch_014
ghpython_script_15 = GhPythonScript(x=point_18, y=point_20, z=point_19, div=number_slider_38, it=number_slider_39)  # -> out, a; inputs x: Point3d, y: Point3d, z: Point3d, div: Int32, it: Int32; disabled
# ---------- ghpython_script_15: Python ----------
import rhinoscriptsyntax as rs
import math

klines = [rs.AddLine(x,y), rs.AddLine(y,z), rs.AddLine(z,x)]

def normal_vec(v):
    sPt = rs.CurveStartPoint(v)
    ePt = rs.CurveEndPoint(v)
    midx = ePt[0] - sPt[0]
    midy = ePt[1] - sPt[1]
    vector = [-midy, midx, 0]
    return rs.VectorUnitize(vector)

def koch_014(linelist, it):
    sample_ln = linelist[:]
    lines = []
    
    if it == 0:
        return sample_ln
    else:
        for i in sample_ln:
            length = rs.CurveLength(i)
            midpt = rs.CurveMidPoint(i)
            pts = rs.DivideCurve(i, div)
            vector = normal_vec(i)
            h = math.sin(math.pi/3) * length/div
            pts.insert(2, rs.MoveObject(midpt, vector * h))
            segment = rs.ExplodeCurves(rs.AddPolyline(pts))
            lines += segment
    it -= 1
    
    return koch_014(lines, it)

a = koch_014(klines, it)
# ---------- end ghpython_script_15 ----------

# ----
panel_25 = Panel([ghpython_script_13.a, ghpython_script_13.b, ghpython_script_13.c, ghpython_script_13.d, ghpython_script_13.e])  # disabled
nurbs_curve = NurbsCurve(Vertices=ghpython_script_14.a, Degree=3, Periodic=False)  # -> Curve, Length, Domain; disabled
interpolate = Interpolate(Vertices=ghpython_script_14.a, Degree=3, Periodic=False, KnotStyle=1)  # -> Curve, Length, Domain; disabled
list_item_2 = ListItem(List=populate_geometry, Index=ghpython_script_13.b, Wrap=True)  # disabled
point_21 = Point(list_item_2)  # disabled
divide_curve = DivideCurve(Curve=interpolate.Curve, Count=number_slider_37, Kinks=False)  # -> Points, Tangents, Parameters; disabled
divide_curve_2 = DivideCurve(Curve=nurbs_curve.Curve, Count=number_slider_37, Kinks=False)  # -> Points, Tangents, Parameters; disabled
sphere_2 = Sphere(Base=point_21, Radius=panel_24)  # disabled
curve_10 = Curve(ghpython_script_15.a)  # disabled
line = Line(StartPoint=divide_curve_2.Points, EndPoint=divide_curve.Points)  # disabled
pipe = Pipe(Curve=[line, nurbs_curve.Curve, interpolate.Curve], Radius=number_slider_40, Caps=0)  # disabled

# ----
# GEOMETRIC APPLICATIONS
# NEW_008 FUNCTIONS
number_slider_41 = Slider(2, range=0..10)  # disabled
number_slider_42 = Slider(5, range=0..10)  # disabled
number_slider_43 = Slider(1, range=0..10)  # disabled
number_slider_44 = Slider(1.6, range=0..2)  # disabled
number_slider_45 = Slider(3.197, range=0..5)  # disabled
number_slider_46 = Slider(4.5, range=0..10)  # disabled
number_slider_47 = Slider(22, range=0..100)  # disabled
number_slider_48 = Slider(18, range=0..100)  # disabled
series = Series(Start=number_slider_41, Step=number_slider_43, Count=number_slider_42)  # disabled
range = Range(Domain=number_slider_44, Steps=10)  # disabled
multiplication = Multiplication(A=number_slider_42, B=range)  # disabled
my_first_function_001_2 = GhPythonScript()  # -> out, a; disabled; same code as my_first_function_001
panel_26 = Panel(my_first_function_001_2.out)  # disabled
pi = Pi(Factor=range)  # disabled

# ---- group: multi_002
ghpython_script_16 = GhPythonScript(num=number_slider_46, y=number_slider_45)  # -> out, a; disabled
# ---------- ghpython_script_16: Python ----------
#1001 FUNCTIONS FROM WICKERSON STUDIOS 2020

import rhinoscriptsyntax as rs

def multi_002(x):
    return x*num

a = multi_002(y)
# ---------- end ghpython_script_16 ----------

# ---- group: fibonacci_004
ghpython_script_17 = GhPythonScript(x=series)  # -> out, a; inputs x: Int32; disabled; same code as ghpython_script_7

# ---- group: odd_even_003
ghpython_script_18 = GhPythonScript(i=number_slider_47, j=number_slider_48)  # -> out, a; inputs i: Int32, j: Int32; disabled; same code as ghpython_script_6

# ----
panel_27 = Panel(ghpython_script_16.a)  # disabled
panel_28 = Panel(ghpython_script_18.out)  # disabled
construct_point_2 = ConstructPoint(XCoordinate=ghpython_script_17.a, YCoordinate=ghpython_script_17.a, ZCoordinate=multiplication)  # disabled
panel_29 = Panel(ghpython_script_17.a)  # disabled
polar_array = PolarArray(Geometry=construct_point_2, Plane=PlaneXY(0, 0, 0), Count=10, Angle=pi)  # -> Geometry, Transform; disabled
interpolate_2 = Interpolate(Vertices=polar_array.Geometry, Degree=3, Periodic=False, KnotStyle=1)  # -> Curve, Length, Domain; disabled
clean_tree = CleanTree(RemoveNulls=True, RemoveInvalid=True, RemoveEmpty=False, Tree=interpolate_2.Curve)  # disabled
loft = Loft(
    Curves=flatten(clean_tree),
    Options={Adjust=False, Closed=False, LoftEnds=0, LoftSimp=0, LoftType=0, Rebuild=10, Refit=0.01})  # disabled

number_slider_49 = Slider(42, range=0..100)  # disabled
surface_2 = Surface(loft)  # disabled
number_slider_50 = Slider(0.981, range=0.001..2)  # disabled
divide_surface = DivideSurface(Surface=surface_2, UCount=number_slider_49, VCount=number_slider_49)  # -> Points, Normals, Parameters; disabled
amplitude = Amplitude(Vector=divide_surface.Normals, Amplitude=number_slider_50)  # disabled
vector_display = VectorDisplay(Anchor=divide_surface.Points, Vector=divide_surface.Normals)  # disabled
move_3 = Move(Geometry=divide_surface.Points, Motion=amplitude)  # -> flatten(Geometry), Transform; disabled
expression = Expression(x=number_slider_49, Expression="x+1")  # disabled
surface_from_points_2 = SurfaceFromPoints(Points=move_3.Geometry, UCount=expression, Interpolate=False)  # disabled
mesh_frompoints = MeshFromPoints(Points=move_3.Geometry, UDirection=expression, VDirection=expression)  # disabled
deconstruct_brep_2 = DeconstructBrep(Brep=surface_from_points_2)  # -> Faces, graft(Edges), Vertices; disabled
deconstruct_brep_3 = DeconstructBrep(Brep=surface_2)  # -> Faces, graft(Edges), Vertices; disabled
loft_2 = Loft(
    Curves=[deconstruct_brep_2.Edges, deconstruct_brep_3.Edges],
    Options={Adjust=False, Closed=False, LoftEnds=0, LoftSimp=0, LoftType=0, Rebuild=10, Refit=0.01})  # -> flatten(Loft); disabled
number_slider_51 = Slider(2, range=0..10)  # disabled

merge = Merge(Data1=surface_from_points_2, Data2=loft_2, Data3=surface_2)  # disabled

brep_join = BrepJoin(Breps=merge)  # -> Breps, Closed; disabled
deconstruct_brep_4 = DeconstructBrep(Brep=brep_join.Breps)  # -> Faces, Edges, Vertices; disabled
list_item_3 = ListItem(List=deconstruct_brep_4.Vertices, Index=number_slider_51, Wrap=True)  # disabled
mirror = Mirror(Geometry=brep_join.Breps, Plane=list_item_3)  # -> Geometry, Transform; disabled
merge_2 = Merge(Data1=brep_join.Breps, Data2=mirror.Geometry)  # disabled

# ----
# NEW_008 POINTS
number_slider_52 = Slider(8, range=0..10)
number_slider_53 = Slider(10, range=0..10)  # disabled
number_slider_54 = Slider(4, range=0..10)  # disabled
number_slider_55 = Slider(10, range=0..10)  # disabled
number_slider_56 = Slider(0.075, range=0..0.1)  # disabled
number_slider_57 = Slider(17, range=0..100)
number_slider_58 = Slider(-0.94, range=-10..10.01)
point_22 = Point(Point(1.786002098, 0.9211885921, 3.831377675))  # disabled
sphere_3 = Sphere(Base=point_22, Radius=1)  # disabled

# ---- group: Points
ghpython_script_19 = GhPythonScript(x=Slider(5, range=0..10), y=Slider(7, range=0..10))  # -> out, points, polyline; inputs x: Int32, y: Int32; same code as ghpython_script

# ---- group: polyline_006
ghpython_script_20 = GhPythonScript(x=number_slider_52, y=Slider(3, range=0..10), z=Slider(6, range=0..10))  # -> out, pointsA, polyline; inputs x: Int32, y: Int32, z: Int32; same code as ghpython_script_2

# ---- group: Surface_007
ghpython_script_21 = GhPythonScript(x=number_slider_57, y=Slider(19, range=0..100), v=number_slider_58, n=Slider(0.83, range=0..10))  # -> out, a; inputs x: Int32, y: Int32; same code as ghpython_script_3

# ---- group: attractor_008
ghpython_script_22 = GhPythonScript(attractor=point_22, x=number_slider_54, y=number_slider_54, z=number_slider_54, v=number_slider_56)  # -> out, point, a, sp, dis; inputs attractor: Point3d, x: Int32, y: Int32, z: Int32; disabled; same code as ghpython_script_4

# ----
curve_11 = Curve(ghpython_script_19.polyline)
point_23 = Point(ghpython_script_19.points)
point_24 = Point(ghpython_script_21.a)
curve_12 = Curve(ghpython_script_20.polyline)
point_25 = Point(ghpython_script_20.pointsA)
surface_from_points_3 = SurfaceFromPoints(Points=point_24, UCount=number_slider_57, Interpolate=False)
delaunay_mesh_2 = DelaunayMesh(Points=point_24, Plane=PlaneXY(0, 0, 0))
point_26 = Point(ghpython_script_22.a)  # disabled
point_27 = Point(ghpython_script_22.point)  # disabled
panel_30 = Panel(ghpython_script_22.dis)  # disabled
geometry_2 = Geometry(ghpython_script_22.sp)  # disabled
weaverbird_s_mesh_window_2 = WeaverbirdsMeshWindow(MeshPolylines=delaunay_mesh_2, Distance=5, InsetType=0)
weaverbird_s_stellate_cumulation_2 = WeaverbirdsStellateCumulation(MeshPolylines=delaunay_mesh_2, Distance=number_slider_58)

# ----
# NEW_008 CURVES
number_slider_59 = Slider(4, range=0..4)  # disabled
number_slider_60 = Slider(5, range=0..100)  # disabled
point_28 = Point(Point(-12.86687905, 6.072204481, 0))  # disabled
point_29 = Point(Point(-2.810931272, -4.24085025, 0))  # disabled
curve_13 = Curve(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)  # disabled
curve_14 = Curve(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)  # disabled
curve_15 = Curve(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)  # disabled
number_slider_61 = Slider(247, range=0..360)  # disabled
number_slider_62 = Slider(4, range=0..4)  # disabled
number_slider_63 = Slider(10, range=0..12)  # disabled
point_30 = Point(Point(-1.546227967, -5.175303394, 0))  # disabled
point_31 = Point(Point(-12.42183345, 7.763754086, 0))  # disabled
number_slider_64 = Slider(4, range=0..4)  # disabled
point_32 = Point(Point(-1.546227967, -5.175303394, 0))  # disabled
point_33 = Point(Point(-12.42183345, 7.763754086, 0))  # disabled
number_slider_65 = Slider(176, range=0..360)  # disabled
number_slider_66 = Slider(4, range=0..4)  # disabled
number_slider_67 = Slider(12, range=0..12)  # disabled
point_34 = Point(Point(-1.546227967, -5.175303394, 0))  # disabled
point_35 = Point(Point(-12.42183345, 7.763754086, 0))  # disabled

# ---- group: rectangle_010
ghpython_script_23 = GhPythonScript(pt1=point_29, pt2=point_28, line_amount=number_slider_59)  # -> out, pt3, pt4, ln1, ln2, ln3, ln4, a; inputs pt1: Point3d, pt2: Point3d, line_amount: Int32; disabled; same code as ghpython_script_8

# ---- group: divide_curve_009
ghpython_script_24 = GhPythonScript(x=number_slider_60, line1=curve_13, line2=curve_14, line3=curve_15)  # -> out, a, b, c, d, ln1, ln2; inputs x: Int32, line1: Curve, line2: Curve, line3: Curve; disabled; same code as ghpython_script_9

# ---- group: rotation_011
ghpython_script_25 = GhPythonScript(pt1=point_30, pt2=point_31, line_amount=number_slider_62, parameter=number_slider_63, full=number_slider_61)  # -> out, pt3, pt4, ln1, ln2, ln3, ln4, a, b; inputs pt1: Point3d, pt2: Point3d, line_amount: Int32, parameter: Int32, full: Int32; disabled; same code as ghpython_script_10

# ---- group: rectangle_010
ghpython_script_26 = GhPythonScript(pt1=point_32, pt2=point_33, line_amount=number_slider_64)  # -> out, pt3, pt4, ln1, ln2, ln3, ln4, a; inputs pt1: Point3d, pt2: Point3d, line_amount: Int32; disabled; same code as ghpython_script_11

# ---- group: rotation_011
ghpython_script_27 = GhPythonScript(pt1=point_34, pt2=point_35, line_amount=number_slider_66, parameter=number_slider_67, full=number_slider_65)  # -> out, pt3, pt4, ln1, ln2, ln3, ln4, a, b; inputs pt1: Point3d, pt2: Point3d, line_amount: Int32, parameter: Int32, full: Int32; disabled; same code as ghpython_script_12

# ----
point_36 = Point(ghpython_script_24.a)  # disabled
curve_16 = Curve(ghpython_script_24.ln1)  # disabled
curve_17 = Curve(ghpython_script_24.ln2)  # disabled
panel_31 = Panel(ghpython_script_23.ln1)  # disabled
panel_32 = Panel(ghpython_script_23.ln2)  # disabled
panel_33 = Panel(ghpython_script_23.ln3)  # disabled
panel_34 = Panel(ghpython_script_23.ln4)  # disabled
panel_35 = Panel(point_36)  # disabled
panel_36 = Panel(ghpython_script_25.ln1)  # disabled
panel_37 = Panel(ghpython_script_25.ln3)  # disabled
panel_38 = Panel(ghpython_script_25.ln4)  # disabled
panel_39 = Panel(ghpython_script_25.ln2)  # disabled
panel_40 = Panel(ghpython_script_26.ln1)  # disabled
panel_41 = Panel(ghpython_script_26.ln2)  # disabled
panel_42 = Panel(ghpython_script_26.ln3)  # disabled
panel_43 = Panel(ghpython_script_26.ln4)  # disabled
curve_18 = Curve(ghpython_script_27.a)  # disabled
curve_19 = Curve(ghpython_script_27.b)  # disabled

# ----
# NEW_008 GEOMETRIES
number_slider_68 = Slider(40, range=0..100)  # disabled
surface_3 = Surface(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)  # disabled
panel_44 = Panel("3")  # disabled
populate_geometry_2 = PopulateGeometry(Geometry=surface_3, Count=number_slider_68, Seed=1)  # disabled
number_slider_69 = Slider(7.26, range=0..10)  # disabled
number_slider_70 = Slider(0.91, range=0..10)  # disabled
number_slider_71 = Slider(100, range=0..100)  # disabled
number_slider_72 = Slider(0.448, range=0..10)  # disabled
number_slider_73 = Slider(2, range=0..10)  # disabled
number_slider_74 = Slider(13, range=0..100)  # disabled
number_slider_75 = Slider(24, range=0..100)  # disabled
polygon_2 = Polygon(Plane=PlaneXY(0, 0, 0), Radius=3, Segments=panel_44, FilletRadius=0)  # -> Polygon, Length; disabled
deconstruct_brep_5 = DeconstructBrep(Brep=polygon_2.Polygon)  # -> Faces, Edges, Vertices; disabled
number_slider_76 = Slider(100, range=0..100)  # disabled
list_item_4 = ListItem(List=deconstruct_brep_5.Vertices, Index=0, Wrap=True)  # -> Item, Item1, Item2; disabled
number_slider_77 = Slider(2, range=0..10)  # disabled
number_slider_78 = Slider(2, range=0..5)  # disabled
point_37 = Point(list_item_4.Item)  # disabled
point_38 = Point(list_item_4.Item1)  # disabled
point_39 = Point(list_item_4.Item2)  # disabled
panel_45 = Panel("4")  # disabled
number_slider_79 = Slider(1.34, range=0..10)  # disabled

# ---- group: random_012
ghpython_script_28 = GhPythonScript(seed=number_slider_75)  # -> out, a, b, c, d, e; inputs seed: Int32; disabled; same code as ghpython_script_13

# ---- group: spiral_013
ghpython_script_29 = GhPythonScript(
    num=number_slider_74,
    v=number_slider_71,
    n=number_slider_73,
    m=number_slider_72,
    Xstretch=number_slider_69,
    Ystretch=number_slider_70)  # -> out, a; inputs num: Int32, v: Int32; disabled; same code as ghpython_script_14

# ---- group: koch_014
ghpython_script_30 = GhPythonScript(x=point_37, y=point_39, z=point_38, div=number_slider_77, it=number_slider_78)  # -> out, a; inputs x: Point3d, y: Point3d, z: Point3d, div: Int32, it: Int32; disabled; same code as ghpython_script_15

# ----
panel_46 = Panel([ghpython_script_28.a, ghpython_script_28.b, ghpython_script_28.c, ghpython_script_28.d, ghpython_script_28.e])  # disabled
nurbs_curve_2 = NurbsCurve(Vertices=ghpython_script_29.a, Degree=3, Periodic=False)  # -> Curve, Length, Domain; disabled
interpolate_3 = Interpolate(Vertices=ghpython_script_29.a, Degree=3, Periodic=False, KnotStyle=1)  # -> Curve, Length, Domain; disabled
list_item_5 = ListItem(List=populate_geometry_2, Index=ghpython_script_28.b, Wrap=True)  # disabled
point_40 = Point(list_item_5)  # disabled
divide_curve_3 = DivideCurve(Curve=interpolate_3.Curve, Count=number_slider_76, Kinks=False)  # -> Points, Tangents, Parameters; disabled
divide_curve_4 = DivideCurve(Curve=nurbs_curve_2.Curve, Count=number_slider_76, Kinks=False)  # -> Points, Tangents, Parameters; disabled
sphere_4 = Sphere(Base=point_40, Radius=panel_45)  # disabled
curve_20 = Curve(ghpython_script_30.a)  # disabled
line_2 = Line(StartPoint=divide_curve_4.Points, EndPoint=divide_curve_3.Points)  # disabled
pipe_2 = Pipe(Curve=[line_2, nurbs_curve_2.Curve, interpolate_3.Curve], Radius=number_slider_79, Caps=0)  # disabled
