# Grasshopper definition PATREON_MEMBERSHIP_ONLY_Rhino7_GHPYTHON_WickersonStudios_GEOMETRIC_APPLICATIONS_(NEW_009_019.gh (Grasshopper 1.0.7)
# Copyright: bernhard muller bijoutiers
# plug-ins: Bifocals, Weaverbird, MeshEdit Components, HoopSnake

# ----
# NEW_008 RESOURCES
# 
# PYTHON IN EASY STEPS
# 
# HEADFIRST PROGRAMMING
# 
# PYTHON.ORG  DOCS
number_slider = Slider(4, range=0..100)  # disabled
unit_x = UnitX(Factor=number_slider)  # disabled
point = Point(<point referenced from the Rhino model>)  # disabled
panel = Panel("sin(60) = x/l")  # disabled
panel_2 = Panel("x = sin(60) * l")  # disabled
move = Move(Geometry=point, Motion=unit_x)  # -> Geometry, Transform; disabled

# ----
# NEW_008 POINTS
number_slider_2 = Slider(8, range=0..10)  # disabled
number_slider_3 = Slider(6, range=0..10)  # disabled
number_slider_4 = Slider(3, range=0..10)  # disabled
number_slider_5 = Slider(10, range=0..10)  # disabled
number_slider_6 = Slider(5, range=0..10)  # disabled
number_slider_7 = Slider(4, range=0..10)  # disabled
number_slider_8 = Slider(7, range=0..10)  # disabled
number_slider_9 = Slider(10, range=0..10)  # disabled
number_slider_10 = Slider(0.075, range=0..0.1)  # disabled
number_slider_11 = Slider(20, range=0..100)  # disabled
number_slider_12 = Slider(19, range=0..100)  # disabled
number_slider_13 = Slider(1.5, range=-10..10.01)  # disabled
number_slider_14 = Slider(0.39, range=0..10)  # disabled
point_2 = Point(Point(1.786002098, 0.9211885921, 3.831377675))  # disabled
sphere = Sphere(Base=point_2, Radius=1)  # disabled

# ---- group: Points
ghpython_script = GhPythonScript(x=number_slider_6, y=number_slider_8)  # -> out, points, polyline; inputs x: Int32, y: Int32; disabled
# ---------- ghpython_script: Python ----------
#libraries

import rhinoscriptsyntax as rs

points = []
def points_005(x,y):
    for i in range(x):
        for j in range(y):
            b = rs.AddPoint(i, j, 0)
            points.append(b)
    
points_005(x,y)
    
polyline = rs.AddPolyline(points, None)
# ---------- end ghpython_script ----------

# ---- group: polyline_006
ghpython_script_2 = GhPythonScript(x=number_slider_2, y=number_slider_4, z=number_slider_3)  # -> out, pointsA, polyline; inputs x: Int32, y: Int32, z: Int32; disabled
# ---------- ghpython_script_2: Python ----------
import rhinoscriptsyntax as rs

pointsA = []
polyline = []
"""
for j in range(x):
    if j % 2 == 0:
        ptsA = rs.AddPoint(j, y, 0)
    else:
        ptsA = rs.AddPoint(j, y, z)
    pointsA.append(ptsA)

"""

def polyline_006():
    for j in range(x):
        if j % 2 == 0:
            ptsA = rs.AddPoint(j, y, 0)
        else:
            ptsA = rs.AddPoint(j, y, z)
        pointsA.append(ptsA)
        polyline.append(rs.AddPolyline(pointsA))
        
polyline_006()
# ---------- end ghpython_script_2 ----------

# ---- group: Surface_007
ghpython_script_3 = GhPythonScript(x=number_slider_12, y=number_slider_11, v=number_slider_13, n=number_slider_14)  # -> out, a; inputs x: Int32, y: Int32; disabled
# ---------- ghpython_script_3: Python ----------
import rhinoscriptsyntax as rs
import math
a = []
"""
for  i in range(10):
    for j in range(10):
        for k in range(10):
            a.append(rs.AddPoint(i,j,k))
"""
def surface_007():
    for  i in range(x):
        for j in range(y):
            a.append(rs.AddPoint(i,j,(math.sin(i*n)* math.cos(j*n))*v))
            
surface_007()
# ---------- end ghpython_script_3 ----------

# ---- group: attractor_008
ghpython_script_4 = GhPythonScript(attractor=point_2, x=number_slider_7, y=number_slider_7, z=number_slider_7, v=number_slider_10)  # -> out, point, a, sp, dis; inputs attractor: Point3d, x: Int32, y: Int32, z: Int32; disabled
# ---------- ghpython_script_4: Python ----------
import rhinoscriptsyntax as rs

a = []
sp = []
dis = []

def attractor_008():
    for i in range(x):
        for j in range(y):
            for k in range(z):
                point = rs.AddPoint(i,j,k)
                a.append(point)
                dis = rs.Distance(attractor, point)
                sp.append(rs.AddSphere(point, dis * v))
                
attractor_008()
"""

for i in range(x):
    for j in range(y):
        for k in range(z):
            point = rs.AddPoint(i,j,k)
            a.append(point)
            dis = rs.Distance(attractor, point)
            sp.append(rs.AddSphere(point, dis * v))
            
"""
# ---------- end ghpython_script_4 ----------

# ----
curve = Curve(ghpython_script.polyline)  # disabled
point_3 = Point(ghpython_script.points)  # disabled
point_4 = Point(ghpython_script_3.a)  # disabled
point_5 = Point(ghpython_script_2.pointsA)  # disabled
curve_2 = Curve(ghpython_script_2.polyline)  # disabled
point_6 = Point(ghpython_script_4.a)  # disabled
point_7 = Point(ghpython_script_4.point)  # disabled
panel_3 = Panel(ghpython_script_4.dis)  # disabled
surface_from_points = SurfaceFromPoints(Points=point_4, UCount=number_slider_12, Interpolate=False)  # disabled
geometry = Geometry(ghpython_script_4.sp)  # disabled
delaunay_mesh = DelaunayMesh(Points=point_4, Plane=PlaneXY(0, 0, 0))  # disabled
weaverbird_s_mesh_window = WeaverbirdsMeshWindow(MeshPolylines=delaunay_mesh, Distance=5, InsetType=0)  # disabled
weaverbird_s_stellate_cumulation = WeaverbirdsStellateCumulation(MeshPolylines=delaunay_mesh, Distance=number_slider_13)  # disabled

# ----
# NEW_008 FUNCTIONS
number_slider_15 = Slider(22, range=0..100)  # disabled
number_slider_16 = Slider(31, range=0..100)  # disabled
number_slider_17 = Slider(27, range=0..100)  # disabled
number_slider_18 = Slider(2, range=0..10)  # disabled
# https://github.com/mwickerson/PATREON_MEMBERS_ONLY_ghpythonNodeBasics
# gitHub: Mwickerson
# SPECIAL THANKS TO Niloofar Zaker
# link: https://rhino3d.education/p/ghpython-introduction?fbclid=IwAR0QmOPmYIqX3xEZdEPj0Jc5QgnMxvOgR6c4pNX9ESg3vAIExDr7up3QCqA
my_first_function_001 = GhPythonScript()  # -> out, a; disabled
# ---------- my_first_function_001: Python ----------
#1001 FUNCTIONS FROM WICKERSON STUDIOS 2020

import rhinoscriptsyntax as rs

def my_first_function_001():
    print ("Wickerson Studios")

print "Life is Too Beautiful!"
my_first_function_001()
print "Life is Too short!"
# ---------- end my_first_function_001 ----------
panel_4 = Panel(my_first_function_001.out)  # disabled

# ---- group: multi_002
ghpython_script_5 = GhPythonScript(y=number_slider_15)  # -> out, a; inputs y: Int32; disabled
# ---------- ghpython_script_5: Python ----------
#1001 FUNCTIONS FROM WICKERSON STUDIOS 2020

import rhinoscriptsyntax as rs

def multi_002(x):
    print x*20

multi_002(y)
# ---------- end ghpython_script_5 ----------

# ---- group: odd_even_003
ghpython_script_6 = GhPythonScript(i=number_slider_17, j=number_slider_16)  # -> out, a; inputs i: Int32, j: Int32; disabled
# ---------- ghpython_script_6: Python ----------
import rhinoscriptsyntax as rs

def odd_even_003(i,j):
    if i % 2 ==0 and j % 2 ==0:
        print "i and j are even"
    elif i % 2 != 0 and j % 2 != 0:
        print " i and j are odd numbers"
    elif i % 2 ==0 and j % 2 != 0:
        print "i is even but j is odd"
    #elif i % 2 != 0 and j % 2 == 0:
    else:
        print "i is odd but j is even"

odd_even_003(20,23)

odd_even_003(i, j)
# ---------- end ghpython_script_6 ----------

# ---- group: fibonacci_004
ghpython_script_7 = GhPythonScript(x=number_slider_18)  # -> out, a; inputs x: Int32; disabled
# ---------- ghpython_script_7: Python ----------
import rhinoscriptsyntax as rs

def fibonacci_004(n):
    if n == 0:
        return 0
    if n == 1:
        return 1
    else:
        return fibonacci_004(n - 2) + fibonacci_004(n - 1)

a = fibonacci_004(x)
# ---------- end ghpython_script_7 ----------

# ----
panel_5 = Panel(ghpython_script_5.out)  # disabled
construct_point = ConstructPoint(XCoordinate=ghpython_script_7.a, YCoordinate=ghpython_script_7.a, ZCoordinate=ghpython_script_7.a)  # disabled
panel_6 = Panel(ghpython_script_7.a)  # disabled
panel_7 = Panel(ghpython_script_6.out)  # disabled

# ----
# NEW_008 CURVES
number_slider_19 = Slider(4, range=0..4)  # disabled
number_slider_20 = Slider(5, range=0..100)  # disabled
point_8 = Point(Point(-12.86687905, 6.072204481, 0))  # disabled
point_9 = Point(Point(-2.810931272, -4.24085025, 0))  # disabled
curve_3 = Curve(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)  # disabled
curve_4 = Curve(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)  # disabled
curve_5 = Curve(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)  # disabled
number_slider_21 = Slider(247, range=0..360)  # disabled
number_slider_22 = Slider(4, range=0..4)  # disabled
number_slider_23 = Slider(10, range=0..12)  # disabled
point_10 = Point(Point(-1.546227967, -5.175303394, 0))  # disabled
point_11 = Point(Point(-12.42183345, 7.763754086, 0))  # disabled
number_slider_24 = Slider(4, range=0..4)  # disabled
point_12 = Point(Point(-1.546227967, -5.175303394, 0))  # disabled
point_13 = Point(Point(-12.42183345, 7.763754086, 0))  # disabled
number_slider_25 = Slider(176, range=0..360)  # disabled
number_slider_26 = Slider(4, range=0..4)  # disabled
number_slider_27 = Slider(12, range=0..12)  # disabled
point_14 = Point(Point(-1.546227967, -5.175303394, 0))  # disabled
point_15 = Point(Point(-12.42183345, 7.763754086, 0))  # disabled

# ---- group: rectangle_010
ghpython_script_8 = GhPythonScript(pt1=point_9, pt2=point_8, line_amount=number_slider_19)  # -> out, pt3, pt4, ln1, ln2, ln3, ln4, a; inputs pt1: Point3d, pt2: Point3d, line_amount: Int32; disabled
# ---------- ghpython_script_8: Python ----------
import rhinoscriptsyntax as rs

#a = pt1[0]

#pt = (4,5,6)

#pt1 = 
#pt2 =
#pt3 =
#pt4 = 

pt3 = rs.AddPoint(pt1[0],pt2[1],0)
pt4 = rs.AddPoint(pt2[0],pt1[1],0)

#ln1 = rs.AddLine(pt1,pt3)
#ln2 = rs.AddLine(pt2,pt4)
#ln3 = rs.AddLine(pt3,pt2)
#ln4 = rs.AddLine(pt4,pt1)

pts = [pt1,pt3,pt2,pt4,pt1]

a = []
for i in range(line_amount):
    #a = rs.AddLine(pts[i],pts[i+1])
    a.append(rs.AddLine(pts[i],pts[i+1]))
# ---------- end ghpython_script_8 ----------

# ---- group: divide_curve_009
ghpython_script_9 = GhPythonScript(x=number_slider_20, line1=curve_3, line2=curve_4, line3=curve_5)  # -> out, a, b, c, d, ln1, ln2; inputs x: Int32, line1: Curve, line2: Curve, line3: Curve; disabled
# ---------- ghpython_script_9: Python ----------
import rhinoscriptsyntax as rs

a = rs.DivideCurve(line1, x)
b = rs.DivideCurve(line2, x)
c = rs.DivideCurve(line3, x)

#c = rs.AddLine(a[0],b[0])
#d = rs.AddLine(a[4],b[4])

ln1 = []
ln2 = []

def divide_curve_009(x):
    for i in range(x):
            f = rs.AddLine(a[i],b[i])
            g = rs.AddLine(b[i],c[i])
            ln1.append(f)
            ln2.append(g)
            

divide_curve_009(x+1)
# ---------- end ghpython_script_9 ----------

# ---- group: rotation_011
ghpython_script_10 = GhPythonScript(pt1=point_10, pt2=point_11, line_amount=number_slider_22, parameter=number_slider_23, full=number_slider_21)  # -> out, pt3, pt4, ln1, ln2, ln3, ln4, a, b; inputs pt1: Point3d, pt2: Point3d, line_amount: Int32, parameter: Int32, full: Int32; disabled
# ---------- ghpython_script_10: Python ----------
import rhinoscriptsyntax as rs
import math

pt3 = rs.AddPoint(pt1[0],pt2[1],0)
pt4 = rs.AddPoint(pt2[0],pt1[1],0)

pts = [pt1,pt3,pt2,pt4,pt1]

a = []

def rectangle_010():
    for i in range(line_amount):
        #a = rs.AddLine(pts[i],pts[i+1])
        a.append(rs.AddLine(pts[i],pts[i+1])) 

rectangle_010()

b = []
curves = []

def rotation_011():
    for j in range(full):
        curves.append(rs.JoinCurves(a, False, None))
        b.append(rs.RotateObject(curves, pt1, math.degrees(j * (full/parameter)), None, True))

rotation_011()
# ---------- end ghpython_script_10 ----------

# ---- group: rectangle_010
ghpython_script_11 = GhPythonScript(pt1=point_12, pt2=point_13, line_amount=number_slider_24)  # -> out, pt3, pt4, ln1, ln2, ln3, ln4, a; inputs pt1: Point3d, pt2: Point3d, line_amount: Int32; disabled
# ---------- ghpython_script_11: Python ----------
import rhinoscriptsyntax as rs

pt3 = rs.AddPoint(pt1[0],pt2[1],0)
pt4 = rs.AddPoint(pt2[0],pt1[1],0)

pts = [pt1,pt3,pt2,pt4,pt1]

a = []

def rectangle_010():
    for i in range(line_amount):
        #a = rs.AddLine(pts[i],pts[i+1])
        a.append(rs.AddLine(pts[i],pts[i+1])) 

rectangle_010()
# ---------- end ghpython_script_11 ----------

# ---- group: rotation_011
ghpython_script_12 = GhPythonScript(pt1=point_14, pt2=point_15, line_amount=number_slider_26, parameter=number_slider_27, full=number_slider_25)  # -> out, pt3, pt4, ln1, ln2, ln3, ln4, a, b; inputs pt1: Point3d, pt2: Point3d, line_amount: Int32, parameter: Int32, full: Int32; disabled
# ---------- ghpython_script_12: Python ----------
import rhinoscriptsyntax as rs
import math

pt3 = rs.AddPoint(pt1[0],pt2[1],0)
pt4 = rs.AddPoint(pt2[0],pt1[1],0)

pts = [pt1,pt3,pt2,pt4,pt1]

a = []

def rectangle_010():
    for i in range(line_amount):
        #a = rs.AddLine(pts[i],pts[i+1])
        a.append(rs.AddLine(pts[i],pts[i+1])) 

rectangle_010()

b = []
curves = []

def rotation_011():
#def rotation_011(full,parameter):
    for j in range(full):
        curves.append(rs.JoinCurves(a, False, None))
        b.append(rs.RotateObject(curves, pt1, math.degrees(j * (full/parameter)), None, True))

rotation_011()
#rotation_011(full,parameter)
# ---------- end ghpython_script_12 ----------

# ----
point_16 = Point(ghpython_script_9.a)  # disabled
curve_6 = Curve(ghpython_script_9.ln1)  # disabled
curve_7 = Curve(ghpython_script_9.ln2)  # disabled
panel_8 = Panel(ghpython_script_8.ln1)  # disabled
panel_9 = Panel(ghpython_script_8.ln2)  # disabled
panel_10 = Panel(ghpython_script_8.ln3)  # disabled
panel_11 = Panel(ghpython_script_8.ln4)  # disabled
panel_12 = Panel(point_16)  # disabled
panel_13 = Panel(ghpython_script_10.ln4)  # disabled
panel_14 = Panel(ghpython_script_10.ln1)  # disabled
panel_15 = Panel(ghpython_script_10.ln3)  # disabled
panel_16 = Panel(ghpython_script_10.ln2)  # disabled
panel_17 = Panel(ghpython_script_11.ln1)  # disabled
panel_18 = Panel(ghpython_script_11.ln2)  # disabled
panel_19 = Panel(ghpython_script_11.ln3)  # disabled
panel_20 = Panel(ghpython_script_11.ln4)  # disabled
curve_8 = Curve(ghpython_script_12.a)  # disabled
curve_9 = Curve(ghpython_script_12.b)  # disabled

# ----
# NEW_008 GEOMETRIES
number_slider_28 = Slider(40, range=0..100)  # disabled
surface = Surface(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)  # disabled
panel_21 = Panel("3")  # disabled
populate_geometry = PopulateGeometry(Geometry=surface, Count=number_slider_28, Seed=1)  # disabled
number_slider_29 = Slider(7.26, range=0..10)  # disabled
number_slider_30 = Slider(0.91, range=0..10)  # disabled
number_slider_31 = Slider(100, range=0..100)  # disabled
number_slider_32 = Slider(2, range=0..10)  # disabled
number_slider_33 = Slider(0.448, range=0..10)  # disabled
number_slider_34 = Slider(13, range=0..100)  # disabled
number_slider_35 = Slider(24, range=0..100)  # disabled
polygon = Polygon(Plane=PlaneXY(0, 0, 0), Radius=3, Segments=panel_21, FilletRadius=0)  # -> Polygon, Length; disabled
deconstruct_brep = DeconstructBrep(Brep=polygon.Polygon)  # -> Faces, Edges, Vertices; disabled
number_slider_36 = Slider(100, range=0..100)  # disabled
list_item = ListItem(List=deconstruct_brep.Vertices, Index=0, Wrap=True)  # -> Item, Item1, Item2; disabled
number_slider_37 = Slider(2, range=0..10)  # disabled
number_slider_38 = Slider(2, range=0..5)  # disabled
point_17 = Point(list_item.Item)  # disabled
point_18 = Point(list_item.Item1)  # disabled
point_19 = Point(list_item.Item2)  # disabled
panel_22 = Panel("4")  # disabled
number_slider_39 = Slider(1.34, range=0..10)  # disabled

# ---- group: random_012
ghpython_script_13 = GhPythonScript(seed=number_slider_35)  # -> out, a, b, c, d, e; inputs seed: Int32; disabled
# ---------- ghpython_script_13: Python ----------
import rhinoscriptsyntax as rs
import random

#random.seed(seed)

a = random.random()

b = random.uniform(1,50)

c = random.randrange(100, 300, 10)

d = random.choice("Wickerson")

list = [5,6,7,8,9]

e = random.randint(120, 1200)
# ---------- end ghpython_script_13 ----------

# ---- group: spiral_013
ghpython_script_14 = GhPythonScript(
    num=number_slider_34,
    v=number_slider_31,
    n=number_slider_32,
    m=number_slider_33,
    Xstretch=number_slider_29,
    Ystretch=number_slider_30)  # -> out, a; inputs num: Int32, v: Int32; disabled
# ---------- ghpython_script_14: Python ----------
import rhinoscriptsyntax as rs
import math

a = []

def spiral_013():
    for i in range(num):
        x = math.cos(i*n) * i * (n + Xstretch)
        y = math.sin(i*n) * i * (n + Ystretch)
        
        if (i < v):
            z = i * n/m
        p = rs.AddPoint(x,y,z)
        a.append(p)

spiral_013()
# ---------- end ghpython_script_14 ----------

# ---- group: koch_014
ghpython_script_15 = GhPythonScript(x=point_17, y=point_19, z=point_18, div=number_slider_37, it=number_slider_38)  # -> out, a; inputs x: Point3d, y: Point3d, z: Point3d, div: Int32, it: Int32; disabled
# ---------- ghpython_script_15: Python ----------
import rhinoscriptsyntax as rs
import math

klines = [rs.AddLine(x,y), rs.AddLine(y,z), rs.AddLine(z,x)]

def normal_vec(v):
    sPt = rs.CurveStartPoint(v)
    ePt = rs.CurveEndPoint(v)
    midx = ePt[0] - sPt[0]
    midy = ePt[1] - sPt[1]
    vector = [-midy, midx, 0]
    return rs.VectorUnitize(vector)

def koch_014(linelist, it):
    sample_ln = linelist[:]
    lines = []
    
    if it == 0:
        return sample_ln
    else:
        for i in sample_ln:
            length = rs.CurveLength(i)
            midpt = rs.CurveMidPoint(i)
            pts = rs.DivideCurve(i, div)
            vector = normal_vec(i)
            h = math.sin(math.pi/3) * length/div
            pts.insert(2, rs.MoveObject(midpt, vector * h))
            segment = rs.ExplodeCurves(rs.AddPolyline(pts))
            lines += segment
    it -= 1
    
    return koch_014(lines, it)

a = koch_014(klines, it)
# ---------- end ghpython_script_15 ----------

# ----
panel_23 = Panel([ghpython_script_13.a, ghpython_script_13.b, ghpython_script_13.c, ghpython_script_13.d, ghpython_script_13.e])  # disabled
nurbs_curve = NurbsCurve(Vertices=ghpython_script_14.a, Degree=3, Periodic=False)  # -> Curve, Length, Domain; disabled
interpolate = Interpolate(Vertices=ghpython_script_14.a, Degree=3, Periodic=False, KnotStyle=1)  # -> Curve, Length, Domain; disabled
list_item_2 = ListItem(List=populate_geometry, Index=ghpython_script_13.b, Wrap=True)  # disabled
point_20 = Point(list_item_2)  # disabled
divide_curve = DivideCurve(Curve=interpolate.Curve, Count=number_slider_36, Kinks=False)  # -> Points, Tangents, Parameters; disabled
divide_curve_2 = DivideCurve(Curve=nurbs_curve.Curve, Count=number_slider_36, Kinks=False)  # -> Points, Tangents, Parameters; disabled
sphere_2 = Sphere(Base=point_20, Radius=panel_22)  # disabled
curve_10 = Curve(ghpython_script_15.a)  # disabled
line = Line(StartPoint=divide_curve_2.Points, EndPoint=divide_curve.Points)  # disabled
pipe = Pipe(Curve=[line, nurbs_curve.Curve, interpolate.Curve], Radius=number_slider_39, Caps=0)  # disabled

# ----
# GEOMETRIC APPLICATIONS
# NEW_008 FUNCTIONS
number_slider_40 = Slider(2, range=0..10)  # disabled
number_slider_41 = Slider(5, range=0..10)  # disabled
number_slider_42 = Slider(1, range=0..10)  # disabled
number_slider_43 = Slider(1.6, range=0..2)  # disabled
number_slider_44 = Slider(3.197, range=0..5)  # disabled
number_slider_45 = Slider(4.5, range=0..10)  # disabled
number_slider_46 = Slider(22, range=0..100)  # disabled
number_slider_47 = Slider(18, range=0..100)  # disabled
series = Series(Start=number_slider_40, Step=number_slider_42, Count=number_slider_41)  # disabled
range = Range(Domain=number_slider_43, Steps=10)  # disabled
multiplication = Multiplication(A=number_slider_41, B=range)  # disabled
my_first_function_001_2 = GhPythonScript()  # -> out, a; disabled; same code as my_first_function_001
panel_24 = Panel(my_first_function_001_2.out)  # disabled
pi = Pi(Factor=range)  # disabled

# ---- group: multi_002
ghpython_script_16 = GhPythonScript(num=number_slider_45, y=number_slider_44)  # -> out, a; disabled
# ---------- ghpython_script_16: Python ----------
#1001 FUNCTIONS FROM WICKERSON STUDIOS 2020

import rhinoscriptsyntax as rs

def multi_002(x):
    return x*num

a = multi_002(y)
# ---------- end ghpython_script_16 ----------

# ---- group: fibonacci_004
ghpython_script_17 = GhPythonScript(x=series)  # -> out, a; inputs x: Int32; disabled; same code as ghpython_script_7

# ---- group: odd_even_003
ghpython_script_18 = GhPythonScript(i=number_slider_46, j=number_slider_47)  # -> out, a; inputs i: Int32, j: Int32; disabled; same code as ghpython_script_6

# ----
panel_25 = Panel(ghpython_script_16.a)  # disabled
panel_26 = Panel(ghpython_script_18.out)  # disabled
construct_point_2 = ConstructPoint(XCoordinate=ghpython_script_17.a, YCoordinate=ghpython_script_17.a, ZCoordinate=multiplication)  # disabled
panel_27 = Panel(ghpython_script_17.a)  # disabled
polar_array = PolarArray(Geometry=construct_point_2, Plane=PlaneXY(0, 0, 0), Count=10, Angle=pi)  # -> Geometry, Transform; disabled
interpolate_2 = Interpolate(Vertices=polar_array.Geometry, Degree=3, Periodic=False, KnotStyle=1)  # -> Curve, Length, Domain; disabled
clean_tree = CleanTree(RemoveNulls=True, RemoveInvalid=True, RemoveEmpty=False, Tree=interpolate_2.Curve)  # disabled
loft = Loft(
    Curves=flatten(clean_tree),
    Options={Adjust=False, Closed=False, LoftEnds=0, LoftSimp=0, LoftType=0, Rebuild=10, Refit=0.01})  # disabled

number_slider_48 = Slider(42, range=0..100)  # disabled
surface_2 = Surface(loft)  # disabled
number_slider_49 = Slider(0.981, range=0.001..2)  # disabled
divide_surface = DivideSurface(Surface=surface_2, UCount=number_slider_48, VCount=number_slider_48)  # -> Points, Normals, Parameters; disabled
amplitude = Amplitude(Vector=divide_surface.Normals, Amplitude=number_slider_49)  # disabled
vector_display = VectorDisplay(Anchor=divide_surface.Points, Vector=divide_surface.Normals)  # disabled
move_2 = Move(Geometry=divide_surface.Points, Motion=amplitude)  # -> flatten(Geometry), Transform; disabled
expression = Expression(x=number_slider_48, Expression="x+1")  # disabled
surface_from_points_2 = SurfaceFromPoints(Points=move_2.Geometry, UCount=expression, Interpolate=False)  # disabled
mesh_frompoints = MeshFromPoints(Points=move_2.Geometry, UDirection=expression, VDirection=expression)  # disabled
deconstruct_brep_2 = DeconstructBrep(Brep=surface_from_points_2)  # -> Faces, graft(Edges), Vertices; disabled
deconstruct_brep_3 = DeconstructBrep(Brep=surface_2)  # -> Faces, graft(Edges), Vertices; disabled
loft_2 = Loft(
    Curves=[deconstruct_brep_2.Edges, deconstruct_brep_3.Edges],
    Options={Adjust=False, Closed=False, LoftEnds=0, LoftSimp=0, LoftType=0, Rebuild=10, Refit=0.01})  # -> flatten(Loft); disabled
number_slider_50 = Slider(2, range=0..10)  # disabled

merge = Merge(Data1=surface_from_points_2, Data2=loft_2, Data3=surface_2)  # disabled

brep_join = BrepJoin(Breps=merge)  # -> Breps, Closed; disabled
deconstruct_brep_4 = DeconstructBrep(Brep=brep_join.Breps)  # -> Faces, Edges, Vertices; disabled
list_item_3 = ListItem(List=deconstruct_brep_4.Vertices, Index=number_slider_50, Wrap=True)  # disabled
mirror = Mirror(Geometry=brep_join.Breps, Plane=list_item_3)  # -> Geometry, Transform; disabled
merge_2 = Merge(Data1=brep_join.Breps, Data2=mirror.Geometry)  # disabled

# ----
# NEW_008 POINTS
number_slider_51 = Slider(19, range=0..100)  # disabled
number_slider_52 = Slider(8.36, range=-10..10.01)  # disabled
number_slider_53 = Slider(1.77, range=0..10)  # disabled
number_slider_54 = Slider(17, range=0..100)  # disabled
number_slider_55 = Slider(3, range=0..10)  # disabled
number_slider_56 = Slider(4, range=0..10)  # disabled
number_slider_57 = Slider(3, range=0..10)  # disabled
number_slider_58 = Slider(0.264, range=0..0.3)  # disabled
number_slider_59 = Slider(0.13, range=0..1)  # disabled
number_slider_60 = Slider(1, range=0..1)  # disabled
number_slider_61 = Slider(3, range=0..10)  # disabled
number_slider_62 = Slider(4, range=0..10)  # disabled
number_slider_63 = Slider(3, range=0..10)  # disabled
number_slider_64 = Slider(0.162, range=0..0.3)  # disabled
number_slider_65 = Slider(0.13, range=0..1)  # disabled
number_slider_66 = Slider(1, range=0..1)  # disabled
point_21 = Point(Point(0.2493951223, -0.3370204026, 1.605808557))  # disabled
quad_sphere = QuadSphere(Base=PlaneXY(0, 0, 0), Radius=number_slider_54)  # disabled
ghpython_script_19 = GhPythonScript(x=number_slider_54, y=number_slider_51, v=number_slider_52, n=number_slider_53)  # -> out, a; inputs x: Int32, y: Int32; disabled; same code as ghpython_script_3
point_22 = Point(Point(0.2493951223, 0.9211885921, 2.91196161))  # disabled
center_box = CenterBox(Base=PlaneXY(0, 0, 0), X=number_slider_59, Y=number_slider_60, Z=number_slider_59)  # disabled
sphere_3 = Sphere(Base=point_21, Radius=1)  # disabled
point_23 = Point(ghpython_script_19.a)  # disabled
center_box_2 = CenterBox(Base=PlaneXY(0, 0, 0), X=number_slider_65, Y=number_slider_66, Z=number_slider_65)  # disabled
sphere_4 = Sphere(Base=point_22, Radius=1)  # disabled
surface_from_points_3 = SurfaceFromPoints(Points=point_23, UCount=number_slider_54, Interpolate=False)  # disabled
deconstruct_brep_5 = DeconstructBrep(Brep=quad_sphere)  # -> Faces, Edges, Vertices; disabled
volume = Volume(Geometry=center_box)  # -> Volume, Centroid; disabled
volume_2 = Volume(Geometry=center_box_2)  # -> Volume, Centroid; disabled
list_item_4 = ListItem(List=deconstruct_brep_5.Faces, Index=0, Wrap=True)  # disabled
md_slider = MDSlider(SliderMode=0, slider_value=Point(0.5, 0.5, 0.5), x_domain=Domain(0, 1), y_domain=Domain(0, 1), z_domain=Domain(0, 1))  # disabled
project = Project(Geometry=surface_from_points_3, Plane=PlaneXY(0, 0, 0))  # -> Geometry, Transform; disabled
number_slider_67 = Slider(2, range=0..2)  # disabled
number_slider_68 = Slider(2, range=0..2)  # disabled
sporph = Sporph(
    Geometry=surface_from_points_3,
    Base=project.Geometry,
    Parameter=md_slider,
    Target=list_item_4,
    Parameter_2=md_slider,
    Rigid=False)  # disabled

# ---- group: attractor_008
ghpython_script_20 = GhPythonScript(attractor=point_21, x=number_slider_56, y=number_slider_55, z=number_slider_57, v=number_slider_58)  # -> out, a, sp, poly, dis; inputs attractor: Point3d, x: Int32, y: Int32, z: Int32; disabled
# ---------- ghpython_script_20: Python ----------
import rhinoscriptsyntax as rs

a = []
sp = []
dis = []
poly = []

def attractor_008():
    for i in range(x):
        for j in range(y):
            for k in range(z):
                point = rs.AddPoint(i,j,k)
                a.append(point)
                dis = rs.Distance(attractor, point)
                print dis
                sp.append(rs.AddSphere(point, dis * v))
                #poly.append(rs.AddPolyline(a, None))
                
attractor_008()

"""

for i in range(x):
    for j in range(y):
        for k in range(z):
            point = rs.AddPoint(i,j,k)
            a.append(point)
            dis = rs.Distance(attractor, point)
            sp.append(rs.AddSphere(point, dis * v))
            
"""
# ---------- end ghpython_script_20 ----------

# ---- group: Points
ghpython_script_21 = GhPythonScript(x=Slider(5, range=0..10), y=Slider(7, range=0..10))  # -> out, points, polyline; inputs x: Int32, y: Int32; same code as ghpython_script

# ---- group: polyline_006
ghpython_script_22 = GhPythonScript(x=Slider(8, range=0..10), y=Slider(3, range=0..10), z=Slider(6, range=0..10))  # -> out, pointsA, polyline; inputs x: Int32, y: Int32, z: Int32; same code as ghpython_script_2

# ---- group: attractor_008
ghpython_script_23 = GhPythonScript(attractor=point_22, x=number_slider_62, y=number_slider_61, z=number_slider_63, v=number_slider_64)  # -> out, a, sp, poly, box; inputs attractor: Point3d, x: Int32, y: Int32, z: Int32; disabled; same code as ghpython_script_20

# ----
curve_11 = Curve(ghpython_script_21.polyline)
point_24 = Point(ghpython_script_21.points)
point_25 = Point(ghpython_script_22.pointsA)
curve_12 = Curve(ghpython_script_22.polyline)
panel_28 = Panel(ghpython_script_20.out)  # disabled
point_26 = Point(ghpython_script_20.a)  # disabled
panel_29 = Panel(ghpython_script_23.out)  # disabled
point_27 = Point(ghpython_script_23.a)  # disabled
orient = Orient(Geometry=center_box, Source=volume.Centroid, Target=point_26)  # -> Geometry, Transform; disabled
orient_2 = Orient(Geometry=center_box_2, Source=volume_2.Centroid, Target=point_27)  # -> Geometry, Transform; disabled
list_length = ListLength(List=orient.Geometry)  # disabled
list_length_2 = ListLength(List=orient_2.Geometry)  # disabled
range_2 = Range(Domain=number_slider_67, Steps=expr("x-1", list_length))  # disabled
range_3 = Range(Domain=number_slider_68, Steps=expr("x-1", list_length_2))  # disabled
line_2 = Line(StartPoint=point_21, EndPoint=point_26)  # disabled
line_3 = Line(StartPoint=point_22, EndPoint=point_27)  # disabled
pi_2 = Pi(Factor=range_2)  # disabled
pi_3 = Pi(Factor=range_3)  # disabled
rotate_3d = Rotate3D(Geometry=orient.Geometry, Angle=pi_2, Center=point_26, Axis=line_2)  # -> Geometry, Transform; disabled
rotate_3d_2 = Rotate3D(Geometry=orient_2.Geometry, Angle=pi_3, Center=point_27, Axis=line_3)  # -> Geometry, Transform; disabled
geometry_2 = Geometry(ghpython_script_20.sp)  # disabled
geometry_3 = Geometry(ghpython_script_23.sp)  # disabled
solid_difference = SolidDifference(BrepsA=geometry_2, BrepsB=rotate_3d.Geometry)  # disabled
solid_difference_2 = SolidDifference(BrepsA=geometry_3, BrepsB=rotate_3d_2.Geometry)  # disabled

number_slider_69 = Slider(42, range=0..100)  # disabled
surface_3 = Surface(sporph)  # disabled
number_slider_70 = Slider(0.981, range=0.001..2)  # disabled
divide_surface_2 = DivideSurface(Surface=surface_3, UCount=number_slider_69, VCount=number_slider_69)  # -> Points, Normals, Parameters; disabled
amplitude_2 = Amplitude(Vector=divide_surface_2.Normals, Amplitude=number_slider_70)  # disabled
vector_display_2 = VectorDisplay(Anchor=divide_surface_2.Points, Vector=divide_surface_2.Normals)  # disabled
move_3 = Move(Geometry=divide_surface_2.Points, Motion=amplitude_2)  # -> flatten(Geometry), Transform; disabled
expression_2 = Expression(x=number_slider_69, Expression="x+1")  # disabled
surface_from_points_4 = SurfaceFromPoints(Points=move_3.Geometry, UCount=expression_2, Interpolate=False)  # disabled
deconstruct_brep_6 = DeconstructBrep(Brep=surface_from_points_4)  # -> Faces, simplify(graft(Edges)), Vertices; disabled
deconstruct_brep_7 = DeconstructBrep(Brep=surface_3)  # -> Faces, simplify(graft(Edges)), Vertices; disabled
loft_3 = Loft(
    Curves=[deconstruct_brep_7.Edges, deconstruct_brep_6.Edges],
    Options={Adjust=False, Closed=False, LoftEnds=0, LoftSimp=0, LoftType=0, Rebuild=10, Refit=0.01})  # -> flatten(Loft); disabled
merge_3 = Merge(Data1=surface_from_points_4, Data2=loft_3, Data3=surface_3)  # disabled
brep_join_2 = BrepJoin(Breps=merge_3)  # -> Breps, Closed; disabled

# ----
# NEW_009 CURVES
number_slider_71 = Slider(10, range=3..10)  # disabled
number_slider_72 = Slider(4, range=3..10)  # disabled
number_slider_73 = Slider(4, range=0..4)  # disabled
number_slider_74 = Slider(4, range=0..4)  # disabled
number_slider_75 = Slider(10, range=0..10)  # disabled
number_slider_76 = Slider(247, range=0..360)  # disabled
number_slider_77 = Slider(4, range=0..4)  # disabled
number_slider_78 = Slider(10, range=0..12)  # disabled
point_28 = Point(Point(-12.86687905, 6.072204481, 0))  # disabled
point_29 = Point(Point(-2.810931272, -4.24085025, 0))  # disabled
point_30 = Point(Point(-1.546227967, -5.175303394, 0))  # disabled
point_31 = Point(Point(-12.42183345, 7.763754086, 0))  # disabled
number_slider_79 = Slider(7, range=0..20)  # disabled
number_slider_80 = Slider(34, range=0..100)  # disabled
number_slider_81 = Slider(100, range=0..100)  # disabled
number_slider_82 = Slider(17, range=0..100)  # disabled
number_slider_83 = Slider(17, range=0..100)  # disabled
number_slider_84 = Slider(27, range=0..100)  # disabled
point_32 = Point(Point(-1.546227967, -5.175303394, 0))  # disabled
point_33 = Point(Point(-12.42183345, 7.763754086, 0))  # disabled
sphere_5 = Sphere(Base=PlaneXY(0, 0, 0), Radius=number_slider_72)  # disabled
number_slider_85 = Slider(4, range=0..4)  # disabled
number_slider_86 = Slider(6, range=0..12)  # disabled
number_slider_87 = Slider(15, range=0..100)  # disabled
populate_geometry_2 = PopulateGeometry(Geometry=sphere_5, Count=number_slider_79, Seed=number_slider_80)  # disabled
random = Random(Range=number_slider_81, Number=number_slider_71, Seed=[number_slider_82, number_slider_83, number_slider_84])  # disabled
point_34 = Point(Point(-1.546227967, -5.175303394, 0))  # disabled
point_35 = Point(Point(-4.389560072, -0.127916157, 11.59657559))  # disabled
number_slider_88 = Slider(2, range=0..10)  # disabled
list_item_5 = ListItem(List=populate_geometry_2, Index=random, Wrap=True)  # -> Item, Item1, Item2; disabled
interpolate_3 = Interpolate(Vertices=list_item_5.Item, Degree=3, Periodic=False, KnotStyle=1)  # -> Curve, Length, Domain; disabled
interpolate_4 = Interpolate(Vertices=list_item_5.Item1, Degree=3, Periodic=False, KnotStyle=1)  # -> Curve, Length, Domain; disabled
interpolate_5 = Interpolate(Vertices=list_item_5.Item2, Degree=3, Periodic=False, KnotStyle=1)  # -> Curve, Length, Domain; disabled
number_slider_89 = Slider(5, range=0..5)  # disabled
number_slider_90 = Slider(4, range=0..10)  # disabled
number_slider_91 = Slider(10, range=2..20)  # disabled
curve_13 = Curve(interpolate_3.Curve)  # disabled
curve_14 = Curve(interpolate_4.Curve)  # disabled
curve_15 = Curve(interpolate_5.Curve)  # disabled
number_slider_92 = Slider(0.05, range=0..1)  # disabled
merge_4 = Merge(Data1=curve_13, Data2=curve_14, Data3=curve_15)  # disabled
number_slider_93 = Slider(48, range=0..100)  # disabled
number_slider_94 = Slider(0.23, range=0..1)  # disabled
number_slider_95 = Slider(2, range=0..2)  # disabled
construct_domain = ConstructDomain(DomainStart=number_slider_92, DomainEnd=number_slider_94)  # disabled
construct_domain_2 = ConstructDomain(DomainStart=number_slider_92, DomainEnd=number_slider_95)  # disabled

# ---- group: rectangle_010
ghpython_script_24 = GhPythonScript(pt1=point_29, pt2=point_28, line_amount=number_slider_73)  # -> out, pt3, pt4, ln1, ln2, ln3, ln4, a; inputs pt1: Point3d, pt2: Point3d, line_amount: Int32; disabled; same code as ghpython_script_8

ghpython_script_25 = GhPythonScript(pt1=point_30, pt2=point_31, line_amount=number_slider_74, z=number_slider_75)  # -> out, pt3, pt4, a; inputs pt1: Point3d, pt2: Point3d, line_amount: Int32; disabled
# ---------- ghpython_script_25: Python ----------
import rhinoscriptsyntax as rs

pt3 = rs.AddPoint(pt1[0],pt2[1],z)
pt4 = rs.AddPoint(pt2[0],pt1[1],z)

pts = [pt1,pt3,pt2,pt4,pt1]

a = []

def rectangle_010():
    for i in range(line_amount):
        #a = rs.AddLine(pts[i],pts[i+1])
        a.append(rs.AddLine(pts[i],pts[i+1])) 

rectangle_010()
# ---------- end ghpython_script_25 ----------

# ---- group: rotation_011
ghpython_script_26 = GhPythonScript(pt1=point_32, pt2=point_33, line_amount=number_slider_77, parameter=number_slider_78, full=number_slider_76)  # -> out, pt3, pt4, ln1, ln2, ln3, ln4, a, b; inputs pt1: Point3d, pt2: Point3d, line_amount: Int32, parameter: Int32, full: Int32; disabled; same code as ghpython_script_10

ghpython_script_27 = GhPythonScript(pt1=point_34, pt2=point_35, line_amount=number_slider_85, parameter=number_slider_86, full=number_slider_87)  # -> out, pt3, pt4, ln1, ln2, ln3, ln4, a, b; inputs pt1: Point3d, pt2: Point3d, line_amount: Int32, parameter: Int32, full: Int32; disabled
# ---------- ghpython_script_27: Python ----------
import rhinoscriptsyntax as rs
import math
import Rhino.Geometry as rg

pt3 = rs.AddPoint(pt1[0],pt2[1],0)
pt4 = rs.AddPoint(pt2[0],pt1[1],0)

pts = [pt1,pt3,pt2,pt4,pt1]

a = []

def rectangle_010():
    for i in range(line_amount):
        #a = rs.AddLine(pts[i],pts[i+1])
        a.append(rs.AddLine(pts[i],pts[i+1])) 

rectangle_010()

b = []
curves = []

def rotation_011():
#def rotation_011(full,parameter):
    for j in range(full):
        curves.append(rs.JoinCurves(a, False, None))
        b.append(rs.RotateObject(curves, pt1, math.degrees(j * math.sin(parameter/full)), None, True))

rotation_011()
#rotation_011(full,parameter)
# ---------- end ghpython_script_27 ----------

# ---- group: divide_curve_009
ghpython_script_28 = GhPythonScript(x=number_slider_91, line1=curve_13, line2=curve_14, line3=curve_15)  # -> out, a, b, c, d, ln1, ln2; inputs x: Int32, line1: Curve, line2: Curve, line3: Curve; disabled
# ---------- ghpython_script_28: Python ----------
import rhinoscriptsyntax as rs

a = rs.DivideCurve(line1, x)
b = rs.DivideCurve(line2, x)
c = rs.DivideCurve(line3, x)
#c = rs.AddLine(a[0],b[0])
#d = rs.AddLine(a[4],b[4])
ln1 = []
ln2 = []

def divide_curve_009(x):
    for i in range(x):
            f = rs.AddLine(a[i],b[i])
            g = rs.AddLine(b[i],c[i])
            ln1.append(f)
            ln2.append(g)

divide_curve_009(x)
# ---------- end ghpython_script_28 ----------

# ----
panel_30 = Panel(ghpython_script_24.ln1)  # disabled
panel_31 = Panel(ghpython_script_24.ln2)  # disabled
panel_32 = Panel(ghpython_script_24.ln3)  # disabled
panel_33 = Panel(ghpython_script_24.ln4)  # disabled
point_36 = Point(ghpython_script_25.pt3)  # disabled
point_37 = Point(ghpython_script_25.pt4)  # disabled
panel_34 = Panel(ghpython_script_26.ln1)  # disabled
panel_35 = Panel(ghpython_script_26.ln3)  # disabled
panel_36 = Panel(ghpython_script_26.ln4)  # disabled
panel_37 = Panel(ghpython_script_26.ln2)  # disabled
curve_16 = Curve(ghpython_script_25.a)  # disabled
curve_17 = Curve(ghpython_script_27.a)  # disabled
curve_18 = Curve(ghpython_script_27.b)  # disabled
list_item_6 = ListItem(List=graft(curve_18), Index=number_slider_88, Wrap=True)  # disabled
join_curves = JoinCurves(Curves=curve_16, Preserve=False)  # disabled
end_points = EndPoints(Curve=list_item_6)  # -> Start, End; disabled
merge_5 = Merge(Data1=point_30, Data2=point_31, Data3=point_37, Data4=point_36)  # disabled
rotate_3d_3 = Rotate3D(Geometry=curve_18, Angle=1.570796327, Center=end_points.Start, Axis=Vector(0, 0, 1))  # -> Geometry, Transform; disabled
loft_4 = Loft(
    Curves=rotate_3d_3.Geometry,
    Options={Adjust=False, Closed=False, LoftEnds=0, LoftSimp=0, LoftType=0, Rebuild=10, Refit=0.01})  # -> flatten(Loft); disabled
list_length_3 = ListLength(List=loft_4)  # disabled
panel_38 = Panel(loft_4)  # disabled
curve_19 = Curve(ghpython_script_28.ln1)  # disabled
curve_20 = Curve(ghpython_script_28.ln2)  # disabled
point_38 = Point(ghpython_script_28.b)  # disabled
point_39 = Point(ghpython_script_28.a)  # disabled
point_40 = Point(ghpython_script_28.c)  # disabled
range_4 = Range(Domain=number_slider_93, Steps=expr("x-1", list_length_3))  # disabled
list_length_4 = ListLength(List=curve_20)  # disabled
list_length_5 = ListLength(List=point_40)  # disabled
clean_tree_2 = CleanTree(RemoveNulls=True, RemoveInvalid=True, RemoveEmpty=False, Tree=loft_4)  # disabled
unit_z = UnitZ(Factor=range_4)  # disabled
range_5 = Range(Domain=construct_domain_2, Steps=expr("x-1", list_length_5))  # -> flatten(Range); disabled
range_6 = Range(Domain=construct_domain, Steps=expr("x-1", list_length_4))  # disabled
move_4 = Move(Geometry=clean_tree_2, Motion=unit_z)  # -> Geometry, Transform; disabled
panel_39 = Panel(point_39)  # disabled
sphere_6 = Sphere(Base=[point_39, point_38, point_40], Radius=range_5)  # -> simplify(graft(Sphere)); disabled
pipe_2 = Pipe(Curve=[curve_19, curve_20, merge_4], Radius=range_6, Caps=1)  # -> simplify(Pipe); disabled
solid_union = SolidUnion(Breps=[pipe_2, sphere_6])  # disabled

# ----
# NEW_009 GEOMETRIES
number_slider_96 = Slider(16, range=0..100)  # disabled
number_slider_97 = Slider(7.26, range=0..10)  # disabled
number_slider_98 = Slider(0.91, range=0..10)  # disabled
number_slider_99 = Slider(100, range=0..100)  # disabled
number_slider_100 = Slider(2, range=0..10)  # disabled
number_slider_101 = Slider(0.448, range=0..10)  # disabled
number_slider_102 = Slider(13, range=0..100)  # disabled
quad_sphere_2 = QuadSphere(Base=PlaneXY(0, 0, 0), Radius=number_slider_96)  # disabled
panel_40 = Panel("3")  # disabled
polygon_2 = Polygon(Plane=PlaneXY(0, 0, 0), Radius=3, Segments=panel_40, FilletRadius=0)  # -> Polygon, Length; disabled
deconstruct_brep_8 = DeconstructBrep(Brep=quad_sphere_2)  # -> Faces, Edges, Vertices; disabled
number_slider_103 = Slider(51, range=0..100)  # disabled
number_slider_104 = Slider(22, range=0..100)  # disabled
number_slider_105 = Slider(10, range=0..100)  # disabled
list_item_7 = ListItem(List=deconstruct_brep_8.Faces, Index=0, Wrap=True)  # disabled
deconstruct_brep_9 = DeconstructBrep(Brep=polygon_2.Polygon)  # -> Faces, Edges, Vertices; disabled
number_slider_106 = Slider(83, range=0..100)  # disabled
populate_geometry_3 = PopulateGeometry(Geometry=list_item_7, Count=number_slider_103, Seed=1)  # disabled
list_item_8 = ListItem(List=deconstruct_brep_9.Vertices, Index=0, Wrap=True)  # -> Item, Item1, Item2; disabled
number_slider_107 = Slider(3, range=0..10)  # disabled
number_slider_108 = Slider(2, range=0..4)  # disabled
range_7 = Range(Domain=number_slider_105, Steps=number_slider_104)  # disabled
number_slider_109 = Slider(7.29, range=0..10)  # disabled
number_slider_110 = Slider(2, range=0..10)  # disabled
point_41 = Point(list_item_8.Item)  # disabled
point_42 = Point(list_item_8.Item1)  # disabled
point_43 = Point(list_item_8.Item2)  # disabled
number_slider_111 = Slider(1.34, range=0..10)  # disabled
construct_domain_3 = ConstructDomain(DomainStart=number_slider_110, DomainEnd=number_slider_109)  # disabled
number_slider_112 = Slider(1, range=0..1)  # disabled
number_slider_113 = Slider(0, range=0..1)  # disabled
panel_41 = Panel("-1")  # disabled
number_slider_114 = Slider(3, range=0..10)  # disabled
unit_z_2 = UnitZ(Factor=number_slider_114)  # disabled
number_slider_115 = Slider(1, range=0..10)  # disabled
panel_42 = Panel("1")  # disabled

# ---- group: spiral_013
ghpython_script_29 = GhPythonScript(
    num=number_slider_102,
    v=number_slider_99,
    n=number_slider_100,
    m=number_slider_101,
    Xstretch=number_slider_97,
    Ystretch=number_slider_98)  # -> out, a; inputs num: Int32, v: Int32; disabled
# ---------- ghpython_script_29: Python ----------
import rhinoscriptsyntax as rs
import math

a = []

def spiral_013():
    for i in range(num):
        x = math.cos(i*n) * i * (n + Xstretch)
        y = math.sin(i*n) * i * (n + Ystretch)
        if (i < v):
            z = i * n/m
        p = rs.AddPoint(x,y,z)
        a.append(p)

spiral_013()
# ---------- end ghpython_script_29 ----------

# ---- group: random_012
ghpython_script_30 = GhPythonScript(y=number_slider_103, seed=range_7)  # -> out, a, b, c, d, e; inputs y: Int32, seed: Int32; disabled
# ---------- ghpython_script_30: Python ----------
import rhinoscriptsyntax as rs
import random

#random.seed(seed)

a = random.random()
b = random.uniform(1,y)
c = random.randrange(100, 300, 10)
d = random.choice("Wickerson")
e = random.randint(0, y)
# ---------- end ghpython_script_30 ----------

# ---- group: koch_014
ghpython_script_31 = GhPythonScript(x=point_41, y=point_43, z=point_42, div=number_slider_107, it=number_slider_108)  # -> out, a; inputs x: Point3d, y: Point3d, z: Point3d, div: Int32, it: Int32; disabled; same code as ghpython_script_15

# ----
interpolate_6 = Interpolate(Vertices=ghpython_script_29.a, Degree=3, Periodic=False, KnotStyle=1)  # -> Curve, Length, Domain; disabled
nurbs_curve_2 = NurbsCurve(Vertices=ghpython_script_29.a, Degree=3, Periodic=False)  # -> Curve, Length, Domain; disabled
divide_curve_3 = DivideCurve(Curve=interpolate_6.Curve, Count=number_slider_106, Kinks=False)  # -> Points, Tangents, Parameters; disabled
divide_curve_4 = DivideCurve(Curve=nurbs_curve_2.Curve, Count=number_slider_106, Kinks=False)  # -> Points, Tangents, Parameters; disabled
list_item_9 = ListItem(List=populate_geometry_3, Index=ghpython_script_30.e, Wrap=True)  # disabled
line_4 = Line(StartPoint=divide_curve_4.Points, EndPoint=divide_curve_3.Points)  # disabled
point_44 = Point(list_item_9)  # disabled
list_length_6 = ListLength(List=point_44)  # disabled
curve_21 = Curve(ghpython_script_31.a)  # disabled
pipe_3 = Pipe(Curve=[line_4, nurbs_curve_2.Curve, interpolate_6.Curve], Radius=number_slider_111, Caps=0)  # disabled
range_8 = Range(Domain=construct_domain_3, Steps=expr("x-1", list_length_6))  # disabled
path_mapper = PathMapper(curve_21, source="{A;B;C}(i)", target="{A;B;C;i/3}")  # disabled
path_mapper_2 = PathMapper(curve_21, source="{A;B;C}(i)", target="{A;B;C;i/2}")  # disabled
panel_43 = Panel([ghpython_script_30.a, ghpython_script_30.b, ghpython_script_30.c, ghpython_script_30.d, ghpython_script_30.e])  # disabled
sphere_7 = Sphere(Base=point_44, Radius=range_8)  # disabled
curve_22 = Curve(path_mapper_2)  # disabled
curve_23 = Curve(path_mapper_2)  # disabled
solid_intersection = SolidIntersection(BrepsA=sphere_7, BrepsB=list_item_7)  # disabled
list_item_10 = ListItem(List=curve_23, Index=number_slider_113, Wrap=True)  # disabled
list_item_11 = ListItem(List=curve_22, Index=number_slider_112, Wrap=True)  # disabled
cull_index = CullIndex(List=solid_intersection, Indices=panel_41, Wrap=True)  # disabled
solid_union_2 = SolidUnion(Breps=cull_index)  # disabled
move_5 = Move(Geometry=list_item_10, Motion=unit_z_2)  # -> Geometry, Transform; disabled
loft_5 = Loft(
    Curves=[move_5.Geometry, list_item_11],
    Options={Adjust=False, Closed=False, LoftEnds=0, LoftSimp=0, LoftType=0, Rebuild=10, Refit=0.01})  # disabled
deconstruct_brep_10 = DeconstructBrep(Brep=loft_5)  # -> Faces, Edges, Vertices; disabled
list_item_12 = ListItem(List=deconstruct_brep_10.Edges, Index=0, Wrap=True)  # -> Item, Item1, Item2, Item3; disabled
flip_curve = FlipCurve(Curve=list_item_12.Item)  # -> simplify(Curve), Flag; disabled
shift_list = ShiftList(List=flatten(list_item_12.Item2), Shift=number_slider_115, Wrap=True)  # -> simplify(List); disabled
loft_6 = Loft(
    Curves=[flip_curve.Curve, shift_list],
    Options={Adjust=False, Closed=True, LoftEnds=0, LoftSimp=0, LoftType=0, Rebuild=10, Refit=0.01})  # disabled
clean_tree_3 = CleanTree(RemoveNulls=True, RemoveInvalid=True, RemoveEmpty=panel_42, Tree=loft_6)  # disabled
panel_44 = Panel(clean_tree_3)  # disabled

hoopsnake = HoopSnake(
    StartingData=join_curves,
    Data=orient_3.Geometry,
    TerminationCondition=number_slider_89,
    Hoopsnake_Data_autoUpdate=False,
    Hoopsnake_Data_dataLimit=2147483647,
    Hoopsnake_Data_resetCounter=True,
    Hoopsnake_Data_updateView=True)  # -> Feedback, FeedbackHistory, LoopsCounter, IterationsCounter; disabled
divide_curve_5 = DivideCurve(Curve=hoopsnake.Feedback, Count=number_slider_90, Kinks=False)  # -> Points, Tangents, Parameters; disabled
orient_3 = Orient(Geometry=hoopsnake.Feedback, Source=merge_5, Target=divide_curve_5.Points)  # -> Geometry, Transform; disabled
panel_45 = Panel(hoopsnake.IterationsCounter)  # disabled
curve_24 = Curve(graft(hoopsnake.FeedbackHistory))  # disabled
curve_25 = Curve(hoopsnake.Feedback)  # disabled
pipe_4 = Pipe(Curve=curve_24, Radius=1, Caps=0)  # disabled
