# Grasshopper definition gift_for_ralph_001.gh (Grasshopper 1.0.7)
# Copyright: bernhard muller bijoutiers
# plug-ins: Workshop

wickerson_s_first_grasshopper_component = WickersonsFirstGrasshopperComponent()

# ---- group: spiral_013
ghpython_script = GhPythonScript(
    num=Slider(13, range=0..100),
    v=Slider(100, range=0..100),
    n=Slider(2, range=0..10),
    m=Slider(0.448, range=0..10),
    Xstretch=Slider(7.26, range=0..10),
    Ystretch=Slider(0.91, range=0..10))  # -> out, a; inputs num: Int32, v: Int32
# ---------- ghpython_script: Python ----------
import rhinoscriptsyntax as rs
import math

a = []

def spiral_013():
    for i in range(num):
        x = math.cos(i*n) * i * (n + Xstretch)
        y = math.sin(i*n) * i * (n + Ystretch)
        if (i < v):
            z = i * n/m
        p = rs.AddPoint(x,y,z)
        a.append(p)

spiral_013()
# ---------- end ghpython_script ----------

# ----
number_slider = Slider(83, range=0..100)
interpolate = Interpolate(Vertices=ghpython_script.a, Degree=3, Periodic=False, KnotStyle=1)  # -> Curve, Length, Domain
nurbs_curve = NurbsCurve(Vertices=ghpython_script.a, Degree=3, Periodic=False)  # -> Curve, Length, Domain
divide_curve = DivideCurve(Curve=interpolate.Curve, Count=number_slider, Kinks=False)  # -> Points, Tangents, Parameters
divide_curve_2 = DivideCurve(Curve=nurbs_curve.Curve, Count=number_slider, Kinks=False)  # -> Points, Tangents, Parameters
line = Line(StartPoint=divide_curve_2.Points, EndPoint=divide_curve.Points)
pipe = Pipe(Curve=[line, nurbs_curve.Curve, interpolate.Curve], Radius=Slider(1.34, range=0..10), Caps=0)
