# Grasshopper definition gift_for_ralph_002.gh (Grasshopper 1.0.7)
# Copyright: bernhard muller bijoutiers

quad_sphere = QuadSphere(Base=PlaneXY(0, 0, 0), Radius=Slider(16, range=0..100))
deconstruct_brep = DeconstructBrep(Brep=quad_sphere)  # -> Faces, Edges, Vertices
number_slider = Slider(51, range=0..100)
list_item = ListItem(List=deconstruct_brep.Faces, Index=0, Wrap=True)
populate_geometry = PopulateGeometry(Geometry=list_item, Count=number_slider, Seed=1)
range = Range(Domain=Slider(10, range=0..100), Steps=Slider(22, range=0..100))

# ---- group: random_012
ghpython_script = GhPythonScript(y=number_slider, seed=range)  # -> out, a, b, c, d, e; inputs y: Int32, seed: Int32
# ---------- ghpython_script: Python ----------
import rhinoscriptsyntax as rs
import random

#random.seed(seed)

a = random.random()
b = random.uniform(1,y)
c = random.randrange(100, 300, 10)
d = random.choice("Wickerson")
e = random.randint(0, y)
# ---------- end ghpython_script ----------

# ----
list_item_2 = ListItem(List=populate_geometry, Index=ghpython_script.e, Wrap=True)
construct_domain = ConstructDomain(DomainStart=Slider(2, range=0..10), DomainEnd=Slider(7.29, range=0..10))
point = Point(list_item_2)
list_length = ListLength(List=point)
range_2 = Range(Domain=construct_domain, Steps=expr("x-1", list_length))
panel = Panel([ghpython_script.a, ghpython_script.b, ghpython_script.c, ghpython_script.d, ghpython_script.e])
sphere = Sphere(Base=point, Radius=range_2)
solid_intersection = SolidIntersection(BrepsA=sphere, BrepsB=list_item)
cull_index = CullIndex(List=solid_intersection, Indices="-1", Wrap=True)
solid_union = SolidUnion(Breps=cull_index)
